# Grasshopper definition 240831 subd structure as_railing multipipe.gh (Grasshopper 1.0.7)
# plug-ins: Bifocals, Weaverbird, Kangaroo2 Components, LunchBox

cluster = Cluster()
number_slider = Slider(15, range=0..100)
number_slider_2 = Slider(0.46, range=0..1)
number_slider_3 = Slider(10, range=0..100)
number_slider_4 = Slider(15, range=0..100)
number_slider_5 = Slider(0.46, range=0..1)
number_slider_6 = Slider(0.46, range=0..1)
top_curve = Curve(<curve referenced from the Rhino model>)
bottom_crv = Curve(<curve referenced from the Rhino model>)
flip = FlipCurve()  # -> Curve, Flag
top_curve_2 = Curve(<curve referenced from the Rhino model>)
bottom_crv_2 = Curve(<curve referenced from the Rhino model>)
top_curve_3 = Curve(<curve referenced from the Rhino model>)
bottom_crv_3 = Curve(<curve referenced from the Rhino model>)
flip_2 = FlipCurve(Curve=bottom_crv_3)  # -> Curve, Flag
curvepoint = PointOnCurve(top_curve, parameter=0.5)
curvepoint_2 = PointOnCurve(bottom_crv, parameter=0.5)
range = Range(Domain=Slider(1, range=0..100), Steps=number_slider)
curvepoint_3 = PointOnCurve(top_curve_2, parameter=0.5)
curvepoint_4 = PointOnCurve(top_curve_3, parameter=0.5)
curvepoint_5 = PointOnCurve(bottom_crv_2, parameter=0.5)
curvepoint_6 = PointOnCurve(bottom_crv_3, parameter=0.5)
range_2 = Range(Domain=Slider(1, range=0..100), Steps=number_slider_4)
range_3 = Range(Domain=Slider(1, range=0..100), Steps=number_slider_3)
tweencrv = TweenCurve(CurveA=top_curve, CurveB=bottom_crv, Factor=range, BlendType=0)
tweencrv_2 = TweenCurve(CurveA=top_curve_2, CurveB=bottom_crv_2, Factor=range_2, BlendType=0)
tweencrv_3 = TweenCurve(CurveA=top_curve_3, CurveB=flip_2.Curve, Factor=range_3, BlendType=0)
pdecon = Deconstruct(Point=curvepoint)  # -> XComponent, YComponent, ZComponent
pdecon_2 = Deconstruct(Point=curvepoint_2)  # -> XComponent, YComponent, ZComponent
pdecon_3 = Deconstruct(Point=curvepoint_3)  # -> XComponent, YComponent, ZComponent
pdecon_4 = Deconstruct(Point=curvepoint_4)  # -> XComponent, YComponent, ZComponent
pdecon_5 = Deconstruct(Point=curvepoint_5)  # -> XComponent, YComponent, ZComponent
pdecon_6 = Deconstruct(Point=curvepoint_6)  # -> XComponent, YComponent, ZComponent
subtraction = Subtraction(A=pdecon.ZComponent, B=pdecon_2.ZComponent)
division = Division(A=subtraction, B=number_slider)
subtraction_2 = Subtraction(A=pdecon_3.ZComponent, B=pdecon_5.ZComponent)
subtraction_3 = Subtraction(A=pdecon_4.ZComponent, B=pdecon_6.ZComponent)
division_2 = Division(A=subtraction_2, B=number_slider_4)
division_3 = Division(A=subtraction_3, B=number_slider_3)
Z = UnitZ(Factor=division)
Z_2 = UnitZ(Factor=division_2)
Z_3 = UnitZ(Factor=division_3)
extr = Extrude(Base=tweencrv, Direction=Z)
extr_2 = Extrude(Base=tweencrv_2, Direction=Z_2)
extr_3 = Extrude(Base=tweencrv_3, Direction=Z_3)
debrep = DeconstructBrep(Brep=extr)  # -> Faces, Edges, Vertices
debrep_2 = DeconstructBrep(Brep=extr_2)  # -> Faces, Edges, Vertices
debrep_3 = DeconstructBrep(Brep=extr_3)  # -> Faces, Edges, Vertices
item = ListItem(List=debrep.Edges, Index=0, Wrap=True)  # -> Item, Item1, Item2, Item3
item_2 = ListItem(List=debrep_2.Edges, Index=0, Wrap=True)  # -> Item, Item1, Item2, Item3
item_3 = ListItem(List=debrep_3.Edges, Index=0, Wrap=True)  # -> Item, Item1, Item2, Item3
crv = Curve(flatten(item.Item3))
crv_2 = Curve(flatten(item.Item1))
crv_3 = Curve(flatten(item_2.Item3))
crv_4 = Curve(flatten(item_3.Item3))
crv_5 = Curve(flatten(item_2.Item1))
crv_6 = Curve(flatten(item_3.Item1))
cull_i = CullIndex(List=crv_2, Indices="0", Wrap=True)  # -> simplify(graft(List))
cull_i_2 = CullIndex(List=crv, Indices="15", Wrap=True)  # -> simplify(graft(List))
cull_i_3 = CullIndex(List=crv_5, Indices="0", Wrap=True)  # -> simplify(graft(List))
cull_i_4 = CullIndex(List=crv_6, Indices="0", Wrap=True)  # -> simplify(graft(List))
cull_i_5 = CullIndex(List=crv_3, Indices="15", Wrap=True)  # -> simplify(graft(List))
cull_i_6 = CullIndex(List=crv_4, Indices="10", Wrap=True)  # -> simplify(graft(List))
panel = Panel(cull_i)
panel_2 = Panel(cull_i_4)
panel_3 = Panel(cull_i_3)
panel_4 = Panel(cull_i_2)
flip_3 = FlipCurve(Curve=cull_i_2)  # -> Curve, Flag
panel_5 = Panel(cull_i_6)
panel_6 = Panel(cull_i_5)
flip_4 = FlipCurve(Curve=cull_i_5)  # -> Curve, Flag
flip_5 = FlipCurve(Curve=cull_i_6)  # -> Curve, Flag
crv_7 = Curve([flip_3.Curve, cull_i])
crv_8 = Curve([flip_4.Curve, cull_i_3])
crv_9 = Curve([flip_5.Curve, cull_i_4])
panel_7 = Panel(crv_7)
panel_8 = Panel(crv_8)
panel_9 = Panel(crv_9)
loft = Loft(Curves=crv_7, Options={Adjust=False, Closed=False, LoftEnds=0, LoftSimp=0, LoftType=0, Rebuild=10, Refit=0.01})
loft_2 = Loft(Curves=crv_8, Options={Adjust=False, Closed=False, LoftEnds=0, LoftSimp=0, LoftType=0, Rebuild=10, Refit=0.01})
loft_3 = Loft(Curves=crv_9, Options={Adjust=False, Closed=False, LoftEnds=0, LoftSimp=0, LoftType=0, Rebuild=10, Refit=0.01})
panel_10 = Panel(cull_i_2)  # disabled
panel_11 = Panel(cull_i_5)  # disabled
panel_12 = Panel(cull_i_6)  # disabled
Z_4 = UnitZ(Factor=Slider(0.3, range=0..5))
Z_5 = UnitZ(Factor=Slider(0.02, range=0..5))
Z_6 = UnitZ(Factor=Slider(0.05, range=0..5))
extr_4 = Extrude(Base=loft, Direction=Z_4)
extr_5 = Extrude(Base=loft_2, Direction=Z_5)
extr_6 = Extrude(Base=loft_3, Direction=Z_6)

debrep_4 = DeconstructBrep(Brep=extr_4)  # -> Faces, Edges, Vertices
debrep_5 = DeconstructBrep(Brep=extr_4)  # -> Faces, Edges, Vertices
item_4 = ListItem(List=debrep_4.Vertices, Index=Slider(5, range=0..10), Wrap=True)
item_5 = ListItem(List=debrep_5.Vertices, Index=Slider(4, range=0..10), Wrap=True)
merge = Merge(Data1=item_4, Data2=item_5)
weave = Weave(Pattern=[0, 1], Stream0=item_4, Stream1=item_5, NullGaps=False)
ln = Line(StartPoint=item_4, EndPoint=item_5)
intcrv = Interpolate(Vertices=flatten([item_5, item_4]), Degree=3, Periodic=False, KnotStyle=1)  # -> Curve, Length, Domain
Z_7 = UnitZ(Factor=Slider(0.9, range=0..1))
move = Move(Geometry=intcrv.Curve, Motion=Z_7)  # -> Geometry, Transform
crv_10 = Curve(move.Geometry)
crv_11 = Curve(intcrv.Curve)
loft_4 = Loft(
    Curves=[crv_10, crv_11],
    Options=flatten({Adjust=False, Closed=False, LoftEnds=0, LoftSimp=0, LoftType=0, Rebuild=10, Refit=0.01}))

debrep_6 = DeconstructBrep(Brep=extr_4)  # -> Faces, Edges, Vertices
debrep_7 = DeconstructBrep(Brep=extr_4)  # -> Faces, Edges, Vertices
item_6 = ListItem(List=debrep_6.Vertices, Index=Slider(2, range=0..10), Wrap=True)
item_7 = ListItem(List=debrep_7.Vertices, Index=Slider(3, range=0..10), Wrap=True)
intcrv_2 = Interpolate(Vertices=flatten([item_7, item_6]), Degree=3, Periodic=False, KnotStyle=1)  # -> Curve, Length, Domain
Z_8 = UnitZ(Factor=Slider(0.9, range=0..1))
move_2 = Move(Geometry=intcrv_2.Curve, Motion=Z_8)  # -> Geometry, Transform
crv_12 = Curve(move_2.Geometry)
crv_13 = Curve(intcrv_2.Curve)
loft_5 = Loft(
    Curves=[crv_12, crv_13],
    Options=flatten({Adjust=False, Closed=False, LoftEnds=0, LoftSimp=0, LoftType=0, Rebuild=10, Refit=0.01}))

Y = UnitY(Factor=Slider(0.03, range=0..5))
Y_2 = UnitY(Factor=Slider(0.03, range=0..5))
debrep_8 = DeconstructBrep(Brep=loft_4)  # -> Faces, Edges, Vertices
extr_7 = Extrude(Base=loft_4, Direction=Y)
extr_8 = Extrude(Base=loft_5, Direction=Y_2)
debrep_9 = DeconstructBrep(Brep=extr_8)  # -> Faces, Edges, Vertices

truss = _2DTruss(CurveA=crv_10, CurveB=crv_11, Divisions=Slider(27, range=0..100), TrussToggle=0)  # -> PrimaryLines, BraceLines, VerticalLines, StructureNodes
crv_14 = Curve(truss.PrimaryLines)
crv_15 = Curve(truss.VerticalLines)
cluster_2 = Cluster_3(curvepoint_2=crv_14, crv=truss.BraceLines, curvepoint=crv_15, L=[crv_15, crv_14])  # -> I, number_slider_2, crv_4
mp = MultiPipe(
    Curves=[crv_12, crv_13, cluster_2.crv_4],
    NodeSize=cluster_2.I,
    EndOffset=1,
    StrutSize=cluster_2.number_slider_2,
    Segment=0,
    KinkAngle=0.6,
    CubeFit=0,
    Caps=0)

volume = Volume(Geometry=extr_7)  # -> Volume, Centroid

truss_2 = _2DTruss(CurveA=crv_12, CurveB=crv_13, Divisions=Slider(27, range=0..100), TrussToggle=0)  # -> PrimaryLines, BraceLines, VerticalLines, StructureNodes
crv_16 = Curve(truss_2.PrimaryLines)
crv_17 = Curve(truss_2.VerticalLines)
cluster_3 = Cluster_2(curvepoint=crv_16, crv=truss_2.BraceLines, curvepoint_2=crv_17, L=[crv_17, crv_16])  # -> I, number_slider_2, crv_4
mp_2 = MultiPipe(
    Curves=[crv_12, crv_13, cluster_3.crv_4],
    NodeSize=cluster_3.I,
    EndOffset=1,
    StrutSize=cluster_3.number_slider_2,
    Segment=0,
    KinkAngle=0.6,
    CubeFit=0,
    Caps=0)

number_slider_7 = Slider(50, range=0..100)  # disabled

number_slider_8 = Slider(1000, range=0..5000)  # disabled
number_slider_9 = Slider(1000, range=0..5000)  # disabled
number_slider_10 = Slider(1000, range=0..5000)  # disabled
rectangle = Rectangle(Plane=PlaneXY(0, 0, 0), XSize=number_slider_8, YSize=number_slider_9, Radius=0)  # -> Rectangle, Length; disabled
Z_9 = UnitZ(Factor=number_slider_10)  # disabled
extr_9 = Extrude(Base=rectangle.Rectangle, Direction=Z_9)  # disabled
cap = CapHoles(Brep=extr_9)  # disabled

subd = SubD(<subd referenced from the Rhino model>)  # disabled
number_slider_11 = Slider(0.9, range=0..1)  # disabled
number_slider_12 = Slider(0.9, range=0..1)  # disabled
volume_2 = Volume(Geometry=cap)  # -> Volume, Centroid; disabled
volume_3 = Volume(Geometry=subd)  # -> Volume, Centroid; disabled
number_slider_13 = Slider(50, range=0..100)  # disabled
scale = Scale(Geometry=cap, Center=volume_2.Centroid, Factor=number_slider_11)  # -> Geometry, Transform; disabled
scale_2 = Scale(Geometry=subd, Center=volume_3.Centroid, Factor=number_slider_12)  # -> Geometry, Transform; disabled
pop3d = Populate3D(Region=extr_9, Count=number_slider_7, Seed=1)  # disabled
pop3d_2 = Populate3D(Region=subd, Count=number_slider_13, Seed=1)  # disabled
voronoi³ = Voronoi3D(Points=pop3d)  # -> Cells, Boundary; disabled
voronoi³_2 = Voronoi3D(Points=pop3d_2)  # -> Cells, Boundary; disabled
volume_4 = Volume(Geometry=voronoi³.Cells)  # -> Volume, Centroid; disabled
volume_5 = Volume(Geometry=voronoi³_2.Cells)  # -> Volume, Centroid; disabled
scale_3 = Scale(Geometry=voronoi³.Cells, Center=volume_4.Centroid, Factor=number_slider_11)  # -> Geometry, Transform; disabled
scale_4 = Scale(Geometry=voronoi³_2.Cells, Center=volume_5.Centroid, Factor=number_slider_12)  # -> Geometry, Transform; disabled
sdiff = SolidDifference(BrepsA=scale.Geometry, BrepsB=scale_3.Geometry)  # disabled
sdiff_2 = SolidDifference(BrepsA=scale_2.Geometry, BrepsB=scale_4.Geometry)  # disabled
debrep_10 = DeconstructBrep(Brep=sdiff)  # -> Faces, Edges, Vertices; disabled
debrep_11 = DeconstructBrep(Brep=sdiff_2)  # -> Faces, Edges, Vertices; disabled
mesh = MeshBrep(
    Brep=debrep_10.Faces,
    Settings={GridMaxCount=0, GridMinCount=16, JaggedSeams=False, MaxEdgeLength=0, MinEdgeLength=0.0001, MinTolerance=0, Refine=True, RefineAngle=0, RelativeTolerance=0.65, SimplePlanes=True, Tolerance=0})  # disabled
mesh_2 = MeshBrep(
    Brep=debrep_11.Faces,
    Settings={GridMaxCount=0, GridMinCount=16, JaggedSeams=False, MaxEdgeLength=0, MinEdgeLength=0.0001, MinTolerance=0, Refine=True, RefineAngle=0, RelativeTolerance=0.65, SimplePlanes=True, Tolerance=0})  # disabled
number_slider_14 = Slider(3, range=0..10)  # disabled
number_slider_15 = Slider(3, range=0..10)  # disabled
mjoin = MeshJoin(Meshes=mesh)  # disabled
mjoin_2 = MeshJoin(Meshes=mesh_2)  # disabled
number_slider_16 = Slider(2000, range=0..5000)  # disabled
number_slider_17 = Slider(80, range=0..5000)  # disabled
number_slider_18 = Slider(2000, range=0..5000)  # disabled
number_slider_19 = Slider(20, range=0..5000)  # disabled
wbcatmullclark = WeaverbirdsCatmullClarkSubdivision(MeshCurves=mjoin, Level=number_slider_14, SmoothNakedEdges=1)  # disabled
wbcatmullclark_2 = WeaverbirdsCatmullClarkSubdivision(MeshCurves=mjoin_2, Level=number_slider_15, SmoothNakedEdges=1)  # disabled
division_4 = Division(A=number_slider_16, B=number_slider_17)  # disabled
X = UnitX(Factor=1)  # disabled
division_5 = Division(A=number_slider_18, B=number_slider_19)  # disabled
X_2 = UnitX(Factor=1)  # disabled
number_slider_20 = Slider(1000, range=0..5000)  # disabled
number_slider_21 = Slider(80, range=0..5000)  # disabled
number_slider_22 = Slider(1000, range=0..5000)  # disabled
number_slider_23 = Slider(20, range=0..5000)  # disabled
contour = Contour(Shape=wbcatmullclark, Point=Point(0, 0, 0), Direction=X, Distance=division_4)  # disabled
contour_2 = Contour(Shape=wbcatmullclark_2, Point=Point(0, 0, 0), Direction=X_2, Distance=division_5)  # disabled
boundary = BoundarySurfaces(Edges=contour)  # disabled
wbnaked = WeaverbirdsNakedBoundary(MeshClosedPolylines=contour_2)  # disabled
division_6 = Division(A=number_slider_20, B=number_slider_21)  # disabled
division_7 = Division(A=number_slider_22, B=number_slider_23)  # disabled
preview = CustomPreview(Material={diffuse=RGB(221, 160, 221), emission=RGB(66, 48, 66), shine=0.5, specular=RGB(255, 255, 255), transparency=0})  # disabled
X_3 = UnitX(Factor=division_6)  # disabled
X_4 = UnitX(Factor=division_7)  # disabled
extr_10 = Extrude(Base=boundary, Direction=X_3)  # disabled
extr_11 = Extrude(Base=wbnaked, Direction=X_4)  # disabled
cap_2 = CapHoles(Brep=extr_10)  # disabled
patch = Patch(Spans=20, Flexibility=1, Trim=True)  # disabled

# ==== cluster Cluster

# ==== cluster Cluster_2
crv = ClusterInput()
L = ClusterInput()
curvepoint = ClusterInput()
curvepoint_2 = ClusterInput()
crv_2 = Curve(crv)
number_slider = Slider(0.01, range=0..0.01)
curvepoint_3 = PointOnCurve(curvepoint_2, parameter=0.759)
curvepoint_4 = PointOnCurve(curvepoint, parameter=1)
curvepoint_5 = PointOnCurve(crv_2, parameter=0.412)
crv_cp = CurveClosestPoint(Point=curvepoint_5, Curve=crv_2)  # -> Point, Parameter, Distance
number_slider_2 = ClusterOutput(Slider(0.5, range=0..1))
smaller = SmallerThan(FirstNumber=crv_cp.Distance, SecondNumber=Slider(0.03, range=0..10))  # -> SmallerThan, OrEqualTo
dom = ConstructDomain(DomainStart=Slider(0.01, range=0..0.01), DomainEnd=Slider(0.04, range=0..0.1))
I = ClusterOutput(dom)
dispatch = Dispatch(List=[crv_2, L], DispatchPattern=smaller.SmallerThan)  # -> ListA, ListB
crv_3 = Curve(dispatch.ListA)
crv_4 = ClusterOutput(crv_3)

# ==== cluster Cluster_3
crv = ClusterInput()
curvepoint = ClusterInput()
crv_2 = Curve(crv)
curvepoint_2 = ClusterInput()
number_slider = Slider(0.01, range=0..0.01)
curvepoint_3 = PointOnCurve(curvepoint, parameter=0.759)
curvepoint_4 = PointOnCurve(curvepoint_2, parameter=1)
curvepoint_5 = PointOnCurve(crv_2, parameter=0.412)
crv_cp = CurveClosestPoint(Point=curvepoint_5, Curve=crv_2)  # -> Point, Parameter, Distance
smaller = SmallerThan(FirstNumber=crv_cp.Distance, SecondNumber=Slider(0.03, range=0..10))  # -> SmallerThan, OrEqualTo
L = ClusterInput()
dom = ConstructDomain(DomainStart=Slider(0.01, range=0..0.01), DomainEnd=Slider(0.04, range=0..0.1))
dispatch = Dispatch(List=[crv_2, L], DispatchPattern=smaller.SmallerThan)  # -> ListA, ListB
number_slider_2 = ClusterOutput(Slider(0.5, range=0..1))
I = ClusterOutput(dom)
crv_3 = Curve(dispatch.ListA)
crv_4 = ClusterOutput(crv_3)
