# Grasshopper definition 240831 subd structure as_railing multipipe_lvl1.gh (Grasshopper 1.0.7)
# plug-ins: Bifocals, Weaverbird, Kangaroo2 Components, LunchBox

cluster = Cluster()
number_slider = Slider(10, range=0..100)
top_curve = Curve(<curve referenced from the Rhino model>)
bottom_crv = Curve(<curve referenced from the Rhino model>)
number_slider_2 = Slider(15, range=0..100)
number_slider_3 = Slider(0.46, range=0..1)
number_slider_4 = Slider(10, range=0..100)
top_curve_2 = Curve(<curve referenced from the Rhino model>)
bottom_crv_2 = Curve(<curve referenced from the Rhino model>)
top_curve_3 = Curve(<curve referenced from the Rhino model>)
bottom_crv_3 = Curve(<curve referenced from the Rhino model>)
number_slider_5 = Slider(10, range=0..100)
flip = FlipCurve(Curve=bottom_crv)  # -> Curve, Flag
top_curve_4 = Curve(<curve referenced from the Rhino model>)
bottom_crv_4 = Curve(<curve referenced from the Rhino model>)
flip_2 = FlipCurve(Curve=bottom_crv_3)  # -> Curve, Flag
curvepoint = PointOnCurve(top_curve, parameter=0.5)
curvepoint_2 = PointOnCurve(bottom_crv, parameter=0.5)
range = Range(Domain=Slider(1, range=0..100), Steps=number_slider)
flip_3 = FlipCurve(Curve=bottom_crv_4)  # -> Curve, Flag
number_slider_6 = Slider(10, range=0..100)
number_slider_7 = Slider(30, range=0..100)
curvepoint_3 = PointOnCurve(top_curve_2, parameter=0.5)
curvepoint_4 = PointOnCurve(bottom_crv_2, parameter=0.5)
curvepoint_5 = PointOnCurve(top_curve_3, parameter=0.5)
top_curve_5 = Curve(<curve referenced from the Rhino model>)
bottom_crv_5 = Curve(<curve referenced from the Rhino model>)
curvepoint_6 = PointOnCurve(bottom_crv_3, parameter=0.5)
range_2 = Range(Domain=Slider(1, range=0..100), Steps=number_slider_2)
top_curve_6 = Curve(<curve referenced from the Rhino model>)
bottom_crv_6 = Curve(<curve referenced from the Rhino model>)
range_3 = Range(Domain=Slider(1, range=0..100), Steps=number_slider_4)
number_slider_8 = Slider(30, range=0..100)
tweencrv = TweenCurve(CurveA=top_curve, CurveB=flip.Curve, Factor=range, BlendType=0)
number_slider_9 = Slider(30, range=0..100)
number_slider_10 = Slider(20, range=0..100)
top_curve_7 = Curve(<curve referenced from the Rhino model>)
bottom_crv_7 = Curve(<curve referenced from the Rhino model>)
curvepoint_7 = PointOnCurve(top_curve_4, parameter=0.5)
curvepoint_8 = PointOnCurve(bottom_crv_4, parameter=0.5)
range_4 = Range(Domain=Slider(1, range=0..100), Steps=number_slider_5)
top_curve_8 = Curve(<curve referenced from the Rhino model>)
bottom_crv_8 = Curve(<curve referenced from the Rhino model>)
number_slider_11 = Slider(30, range=0..100)
top_curve_9 = Curve(<curve referenced from the Rhino model>)
bottom_crv_9 = Curve(<curve referenced from the Rhino model>)
flip_4 = FlipCurve(Curve=bottom_crv_5)  # -> Curve, Flag
tweencrv_2 = TweenCurve(CurveA=top_curve_2, CurveB=bottom_crv_2, Factor=range_2, BlendType=0)
tweencrv_3 = TweenCurve(CurveA=top_curve_3, CurveB=bottom_crv_3, Factor=range_3, BlendType=0)
flip_5 = FlipCurve(Curve=bottom_crv_6)  # -> Curve, Flag
top_curve_10 = Curve(<curve referenced from the Rhino model>)
bottom_crv_10 = Curve(<curve referenced from the Rhino model>)
flip_6 = FlipCurve(Curve=bottom_crv_7)  # -> Curve, Flag
tweencrv_4 = TweenCurve(CurveA=top_curve_4, CurveB=bottom_crv_4, Factor=range_4, BlendType=0)
flip_7 = FlipCurve(Curve=bottom_crv_8)  # -> Curve, Flag
flip_8 = FlipCurve(Curve=bottom_crv_9)  # -> Curve, Flag
curvepoint_9 = PointOnCurve(top_curve_5, parameter=0.5)
curvepoint_10 = PointOnCurve(bottom_crv_5, parameter=0.5)
curvepoint_11 = PointOnCurve(top_curve_6, parameter=0.5)
flip_9 = FlipCurve(Curve=bottom_crv_10)  # -> Curve, Flag
range_5 = Range(Domain=Slider(1, range=0..100), Steps=number_slider_6)
curvepoint_12 = PointOnCurve(bottom_crv_6, parameter=0.5)
range_6 = Range(Domain=Slider(1, range=0..100), Steps=number_slider_7)
curvepoint_13 = PointOnCurve(top_curve_7, parameter=0.5)
curvepoint_14 = PointOnCurve(bottom_crv_7, parameter=0.5)
range_7 = Range(Domain=Slider(1, range=0..100), Steps=number_slider_8)
curvepoint_15 = PointOnCurve(top_curve_8, parameter=0.5)
curvepoint_16 = PointOnCurve(top_curve_9, parameter=0.5)
curvepoint_17 = PointOnCurve(bottom_crv_8, parameter=0.5)
pdecon = Deconstruct(Point=curvepoint_3)  # -> XComponent, YComponent, ZComponent
curvepoint_18 = PointOnCurve(bottom_crv_9, parameter=0.5)
range_8 = Range(Domain=Slider(1, range=0..100), Steps=number_slider_9)
tweencrv_5 = TweenCurve(CurveA=top_curve_5, CurveB=bottom_crv_5, Factor=range_5, BlendType=0)
pdecon_2 = Deconstruct(Point=curvepoint_4)  # -> XComponent, YComponent, ZComponent
range_9 = Range(Domain=Slider(1, range=0..100), Steps=number_slider_10)
tweencrv_6 = TweenCurve(CurveA=top_curve_6, CurveB=bottom_crv_6, Factor=range_6, BlendType=0)
curvepoint_19 = PointOnCurve(top_curve_10, parameter=0.5)
curvepoint_20 = PointOnCurve(bottom_crv_10, parameter=0.5)
range_10 = Range(Domain=Slider(1, range=0..100), Steps=number_slider_11)
Z = UnitZ(Factor=Slider(0.15, range=0..5))
tweencrv_7 = TweenCurve(CurveA=top_curve_7, CurveB=bottom_crv_7, Factor=range_7, BlendType=0)
cluster_2 = Cluster_5(P=curvepoint, P_2=curvepoint_2, B=number_slider, B_2=tweencrv)  # -> L, V
tweencrv_8 = TweenCurve(CurveA=top_curve_8, CurveB=bottom_crv_8, Factor=range_8, BlendType=0)
tweencrv_9 = TweenCurve(CurveA=top_curve_9, CurveB=bottom_crv_9, Factor=range_9, BlendType=0)
Z_2 = UnitZ(Factor=Slider(0.15, range=0..5))
tweencrv_10 = TweenCurve(CurveA=top_curve_10, CurveB=bottom_crv_10, Factor=range_10, BlendType=0)
subtraction = Subtraction(A=pdecon.ZComponent, B=pdecon_2.ZComponent)
division = Division(A=subtraction, B=number_slider_2)
cluster_3 = Cluster_5(P=curvepoint_5, P_2=curvepoint_6, B=number_slider_4, B_2=tweencrv_3)  # -> L, V
Z_3 = UnitZ(Factor=Slider(0.15, range=0..5))
Z_4 = UnitZ(Factor=division)
cluster_4 = Cluster_5(P=curvepoint_7, P_2=curvepoint_8, B=number_slider_5, B_2=tweencrv_4)  # -> L, V
Z_5 = UnitZ(Factor=Slider(0.15, range=0..5))
extr = Extrude(Base=cluster_2.L, Direction=Z)
Z_6 = UnitZ(Factor=Slider(0.15, range=0..5))
extr_2 = Extrude(Base=tweencrv_2, Direction=Z_4)
cluster_5 = Cluster_5(P=curvepoint_9, P_2=curvepoint_10, B=number_slider_6, B_2=tweencrv_5)  # -> L, V
Z_7 = UnitZ(Factor=Slider(0.15, range=0..5))
pdecon_3 = Deconstruct(Point=curvepoint_11)  # -> XComponent, YComponent, ZComponent
pdecon_4 = Deconstruct(Point=curvepoint_12)  # -> XComponent, YComponent, ZComponent
Z_8 = UnitZ(Factor=Slider(0.15, range=0..5))
extr_3 = Extrude(Base=cluster_3.L, Direction=Z_2)
Z_9 = UnitZ(Factor=Slider(0.15, range=0..5))
pdecon_5 = Deconstruct(Point=curvepoint_13)  # -> XComponent, YComponent, ZComponent
pdecon_6 = Deconstruct(Point=curvepoint_14)  # -> XComponent, YComponent, ZComponent
Z_10 = UnitZ(Factor=Slider(0.15, range=0..5))
pdecon_7 = Deconstruct(Point=curvepoint_15)  # -> XComponent, YComponent, ZComponent
pdecon_8 = Deconstruct(Point=curvepoint_16)  # -> XComponent, YComponent, ZComponent
pdecon_9 = Deconstruct(Point=curvepoint_17)  # -> XComponent, YComponent, ZComponent
pdecon_10 = Deconstruct(Point=curvepoint_18)  # -> XComponent, YComponent, ZComponent
pdecon_11 = Deconstruct(Point=curvepoint_19)  # -> XComponent, YComponent, ZComponent
pdecon_12 = Deconstruct(Point=curvepoint_20)  # -> XComponent, YComponent, ZComponent
subtraction_2 = Subtraction(A=pdecon_3.ZComponent, B=pdecon_4.ZComponent)
division_2 = Division(A=subtraction_2, B=number_slider_7)
subtraction_3 = Subtraction(A=pdecon_5.ZComponent, B=pdecon_6.ZComponent)
Z_11 = UnitZ(Factor=division_2)
division_3 = Division(A=subtraction_3, B=number_slider_8)
subtraction_4 = Subtraction(A=pdecon_7.ZComponent, B=pdecon_9.ZComponent)
subtraction_5 = Subtraction(A=pdecon_8.ZComponent, B=pdecon_10.ZComponent)
division_4 = Division(A=subtraction_4, B=number_slider_9)
Z_12 = UnitZ(Factor=division_3)
division_5 = Division(A=subtraction_5, B=number_slider_10)
subtraction_6 = Subtraction(A=pdecon_11.ZComponent, B=pdecon_12.ZComponent)
Z_13 = UnitZ(Factor=division_4)
Z_14 = UnitZ(Factor=division_5)
division_6 = Division(A=subtraction_6, B=number_slider_11)
Z_15 = UnitZ(Factor=division_6)
extr_4 = Extrude(Base=tweencrv_6, Direction=Z_11)
extr_5 = Extrude(Base=tweencrv_7, Direction=Z_12)
extr_6 = Extrude(Base=tweencrv_8, Direction=Z_13)
extr_7 = Extrude(Base=tweencrv_9, Direction=Z_14)
extr_8 = Extrude(Base=tweencrv_10, Direction=Z_15)
debrep = DeconstructBrep(Brep=extr_4)  # -> Faces, Edges, Vertices
debrep_2 = DeconstructBrep(Brep=extr_5)  # -> Faces, Edges, Vertices
debrep_3 = DeconstructBrep(Brep=extr_6)  # -> Faces, Edges, Vertices
debrep_4 = DeconstructBrep(Brep=extr_7)  # -> Faces, Edges, Vertices
debrep_5 = DeconstructBrep(Brep=extr_8)  # -> Faces, Edges, Vertices
item = ListItem(List=debrep.Edges, Index=0, Wrap=True)  # -> Item, Item1, Item2, Item3
item_2 = ListItem(List=debrep_2.Edges, Index=0, Wrap=True)  # -> Item, Item1, Item2, Item3
item_3 = ListItem(List=debrep_3.Edges, Index=0, Wrap=True)  # -> Item, Item1, Item2, Item3
item_4 = ListItem(List=debrep_4.Edges, Index=0, Wrap=True)  # -> Item, Item1, Item2, Item3
item_5 = ListItem(List=debrep_5.Edges, Index=0, Wrap=True)  # -> Item, Item1, Item2, Item3
crv = Curve(flatten(item.Item3))
crv_2 = Curve(flatten(item.Item1))
crv_3 = Curve(flatten(item_2.Item3))
crv_4 = Curve(flatten(item_2.Item1))
crv_5 = Curve(flatten(item_3.Item3))
crv_6 = Curve(flatten(item_4.Item3))
crv_7 = Curve(flatten(item_3.Item1))
crv_8 = Curve(flatten(item_4.Item1))
crv_9 = Curve(flatten(item_5.Item3))
crv_10 = Curve(flatten(item_5.Item1))
cull_i = CullIndex(List=crv_2, Indices="0", Wrap=True)  # -> simplify(graft(List))
cull_i_2 = CullIndex(List=crv, Indices="30", Wrap=True)  # -> simplify(graft(List))
cull_i_3 = CullIndex(List=crv_4, Indices="0", Wrap=True)  # -> simplify(graft(List))
cull_i_4 = CullIndex(List=crv_3, Indices="30", Wrap=True)  # -> simplify(graft(List))
cull_i_5 = CullIndex(List=crv_7, Indices="0", Wrap=True)  # -> simplify(graft(List))
cull_i_6 = CullIndex(List=crv_5, Indices="30", Wrap=True)  # -> simplify(graft(List))
cull_i_7 = CullIndex(List=crv_8, Indices="0", Wrap=True)  # -> simplify(graft(List))
cull_i_8 = CullIndex(List=crv_6, Indices="20", Wrap=True)  # -> simplify(graft(List))
cull_i_9 = CullIndex(List=crv_10, Indices="0", Wrap=True)  # -> simplify(graft(List))
cull_i_10 = CullIndex(List=crv_9, Indices="30", Wrap=True)  # -> simplify(graft(List))
panel = Panel(cull_i)
panel_2 = Panel(cull_i_3)
panel_3 = Panel(cull_i_2)
flip_10 = FlipCurve(Curve=cull_i_2)  # -> Curve, Flag
panel_4 = Panel(cull_i_5)
panel_5 = Panel(cull_i_7)
panel_6 = Panel(cull_i_4)
flip_11 = FlipCurve(Curve=cull_i_4)  # -> Curve, Flag
panel_7 = Panel(cull_i_9)
panel_8 = Panel(cull_i_6)
panel_9 = Panel(cull_i_8)
flip_12 = FlipCurve(Curve=cull_i_6)  # -> Curve, Flag
flip_13 = FlipCurve(Curve=cull_i_8)  # -> Curve, Flag
panel_10 = Panel(cull_i_10)
flip_14 = FlipCurve(Curve=cull_i_10)  # -> Curve, Flag
crv_11 = Curve([flip_10.Curve, cull_i])
crv_12 = Curve([flip_11.Curve, cull_i_3])
crv_13 = Curve([flip_12.Curve, cull_i_5])
crv_14 = Curve([flip_13.Curve, cull_i_7])
crv_15 = Curve([flip_14.Curve, cull_i_9])
panel_11 = Panel(crv_11)
panel_12 = Panel(crv_12)
panel_13 = Panel(crv_13)
panel_14 = Panel(crv_14)
loft = Loft(Curves=crv_11, Options={Adjust=False, Closed=False, LoftEnds=0, LoftSimp=0, LoftType=0, Rebuild=10, Refit=0.01})
panel_15 = Panel(crv_15)
loft_2 = Loft(Curves=crv_12, Options={Adjust=False, Closed=False, LoftEnds=0, LoftSimp=0, LoftType=0, Rebuild=10, Refit=0.01})
loft_3 = Loft(Curves=crv_13, Options={Adjust=False, Closed=False, LoftEnds=0, LoftSimp=0, LoftType=0, Rebuild=10, Refit=0.01})
loft_4 = Loft(Curves=crv_14, Options={Adjust=False, Closed=False, LoftEnds=0, LoftSimp=0, LoftType=0, Rebuild=10, Refit=0.01})
loft_5 = Loft(Curves=crv_15, Options={Adjust=False, Closed=False, LoftEnds=0, LoftSimp=0, LoftType=0, Rebuild=10, Refit=0.01})
panel_16 = Panel(cull_i_2)  # disabled
panel_17 = Panel(cull_i_4)  # disabled
panel_18 = Panel(cull_i_6)  # disabled
panel_19 = Panel(cull_i_8)  # disabled
panel_20 = Panel(cull_i_10)  # disabled
Z_16 = UnitZ(Factor=Slider(0.05, range=0..5))
Z_17 = UnitZ(Factor=Slider(0.05, range=0..5))
Z_18 = UnitZ(Factor=Slider(0.05, range=0..5))
Z_19 = UnitZ(Factor=Slider(0.05, range=0..5))
extr_9 = Extrude(Base=cluster_4.L, Direction=Z_3)
Z_20 = UnitZ(Factor=Slider(0.05, range=0..5))
debrep_6 = DeconstructBrep(Brep=extr_2)  # -> Faces, Edges, Vertices
extr_10 = Extrude(Base=cluster_5.L, Direction=Z_5)
extr_11 = Extrude(Base=loft, Direction=Z_6)
extr_12 = Extrude(Base=loft_2, Direction=Z_7)
item_6 = ListItem(List=debrep_6.Edges, Index=0, Wrap=True)  # -> Item, Item1, Item2, Item3
extr_13 = Extrude(Base=loft_3, Direction=Z_8)
extr_14 = Extrude(Base=loft_4, Direction=Z_9)
extr_15 = Extrude(Base=loft_5, Direction=Z_10)
crv_16 = Curve(flatten(item_6.Item3))

debrep_7 = DeconstructBrep(Brep=extr)  # -> Faces, Edges, Vertices
debrep_8 = DeconstructBrep(Brep=extr)  # -> Faces, Edges, Vertices
item_7 = ListItem(List=debrep_7.Vertices, Index=Slider(5, range=0..10), Wrap=True)
item_8 = ListItem(List=debrep_8.Vertices, Index=Slider(4, range=0..10), Wrap=True)
merge = Merge(Data1=item_7, Data2=item_8)
weave = Weave(Pattern=[0, 1], Stream0=item_7, Stream1=item_8, NullGaps=False)
ln = Line(StartPoint=item_7, EndPoint=item_8)
intcrv = Interpolate(Vertices=flatten([item_8, item_7]), Degree=3, Periodic=False, KnotStyle=1)  # -> Curve, Length, Domain
Z_21 = UnitZ(Factor=Slider(0.9, range=0..1))
move = Move(Geometry=intcrv.Curve, Motion=Z_21)  # -> Geometry, Transform
crv_17 = Curve(move.Geometry)
crv_18 = Curve(intcrv.Curve)
loft_6 = Loft(
    Curves=[crv_17, crv_18],
    Options=flatten({Adjust=False, Closed=False, LoftEnds=0, LoftSimp=0, LoftType=0, Rebuild=10, Refit=0.01}))

debrep_9 = DeconstructBrep(Brep=extr)  # -> Faces, Edges, Vertices
debrep_10 = DeconstructBrep(Brep=extr)  # -> Faces, Edges, Vertices
item_9 = ListItem(List=debrep_9.Vertices, Index=Slider(2, range=0..10), Wrap=True)
item_10 = ListItem(List=debrep_10.Vertices, Index=Slider(3, range=0..10), Wrap=True)
intcrv_2 = Interpolate(Vertices=flatten([item_10, item_9]), Degree=3, Periodic=False, KnotStyle=1)  # -> Curve, Length, Domain
Z_22 = UnitZ(Factor=Slider(0.9, range=0..1))
move_2 = Move(Geometry=intcrv_2.Curve, Motion=Z_22)  # -> Geometry, Transform
crv_19 = Curve(move_2.Geometry)
crv_20 = Curve(intcrv_2.Curve)
loft_7 = Loft(
    Curves=[crv_19, crv_20],
    Options=flatten({Adjust=False, Closed=False, LoftEnds=0, LoftSimp=0, LoftType=0, Rebuild=10, Refit=0.01}))

crv_21 = Curve(flatten(item_6.Item1))

debrep_11 = DeconstructBrep(Brep=extr_3)  # -> Faces, Edges, Vertices
debrep_12 = DeconstructBrep(Brep=extr_3)  # -> Faces, Edges, Vertices
item_11 = ListItem(List=debrep_11.Vertices, Index=Slider(5, range=0..10), Wrap=True)
item_12 = ListItem(List=debrep_12.Vertices, Index=Slider(4, range=0..10), Wrap=True)
merge_2 = Merge(Data1=item_11, Data2=item_12)
weave_2 = Weave(Pattern=[0, 1], Stream0=item_11, Stream1=item_12, NullGaps=False)
ln_2 = Line(StartPoint=item_11, EndPoint=item_12)
intcrv_3 = Interpolate(Vertices=flatten([item_12, item_11]), Degree=3, Periodic=False, KnotStyle=1)  # -> Curve, Length, Domain
Z_23 = UnitZ(Factor=Slider(0.9, range=0..1))
move_3 = Move(Geometry=intcrv_3.Curve, Motion=Z_23)  # -> Geometry, Transform
crv_22 = Curve(move_3.Geometry)
crv_23 = Curve(intcrv_3.Curve)
loft_8 = Loft(
    Curves=[crv_22, crv_23],
    Options=flatten({Adjust=False, Closed=False, LoftEnds=0, LoftSimp=0, LoftType=0, Rebuild=10, Refit=0.01}))

debrep_13 = DeconstructBrep(Brep=extr_3)  # -> Faces, Edges, Vertices
debrep_14 = DeconstructBrep(Brep=extr_3)  # -> Faces, Edges, Vertices
item_13 = ListItem(List=debrep_13.Vertices, Index=Slider(2, range=0..10), Wrap=True)
item_14 = ListItem(List=debrep_14.Vertices, Index=Slider(3, range=0..10), Wrap=True)
intcrv_4 = Interpolate(Vertices=flatten([item_14, item_13]), Degree=3, Periodic=False, KnotStyle=1)  # -> Curve, Length, Domain
Z_24 = UnitZ(Factor=Slider(0.9, range=0..1))
move_4 = Move(Geometry=intcrv_4.Curve, Motion=Z_24)  # -> Geometry, Transform
crv_24 = Curve(move_4.Geometry)
crv_25 = Curve(intcrv_4.Curve)
loft_9 = Loft(
    Curves=[crv_24, crv_25],
    Options=flatten({Adjust=False, Closed=False, LoftEnds=0, LoftSimp=0, LoftType=0, Rebuild=10, Refit=0.01}))

debrep_15 = DeconstructBrep(Brep=extr_9)  # -> Faces, Edges, Vertices
debrep_16 = DeconstructBrep(Brep=extr_9)  # -> Faces, Edges, Vertices
item_15 = ListItem(List=debrep_15.Vertices, Index=Slider(5, range=0..10), Wrap=True)
item_16 = ListItem(List=debrep_16.Vertices, Index=Slider(4, range=0..10), Wrap=True)
merge_3 = Merge(Data1=item_15, Data2=item_16)
weave_3 = Weave(Pattern=[0, 1], Stream0=item_15, Stream1=item_16, NullGaps=False)
ln_3 = Line(StartPoint=item_15, EndPoint=item_16)
intcrv_5 = Interpolate(Vertices=flatten([item_16, item_15]), Degree=3, Periodic=False, KnotStyle=1)  # -> Curve, Length, Domain
Z_25 = UnitZ(Factor=Slider(0.9, range=0..1))
move_5 = Move(Geometry=intcrv_5.Curve, Motion=Z_25)  # -> Geometry, Transform
crv_26 = Curve(move_5.Geometry)
crv_27 = Curve(intcrv_5.Curve)
loft_10 = Loft(
    Curves=[crv_26, crv_27],
    Options=flatten({Adjust=False, Closed=False, LoftEnds=0, LoftSimp=0, LoftType=0, Rebuild=10, Refit=0.01}))

debrep_17 = DeconstructBrep(Brep=extr_9)  # -> Faces, Edges, Vertices
debrep_18 = DeconstructBrep(Brep=extr_9)  # -> Faces, Edges, Vertices
item_17 = ListItem(List=debrep_17.Vertices, Index=Slider(2, range=0..10), Wrap=True)
item_18 = ListItem(List=debrep_18.Vertices, Index=Slider(3, range=0..10), Wrap=True)
intcrv_6 = Interpolate(Vertices=flatten([item_18, item_17]), Degree=3, Periodic=False, KnotStyle=1)  # -> Curve, Length, Domain
Z_26 = UnitZ(Factor=Slider(0.9, range=0..1))
move_6 = Move(Geometry=intcrv_6.Curve, Motion=Z_26)  # -> Geometry, Transform
crv_28 = Curve(move_6.Geometry)
crv_29 = Curve(intcrv_6.Curve)
loft_11 = Loft(
    Curves=[crv_28, crv_29],
    Options=flatten({Adjust=False, Closed=False, LoftEnds=0, LoftSimp=0, LoftType=0, Rebuild=10, Refit=0.01}))

cull_i_11 = CullIndex(List=crv_21, Indices="0", Wrap=True)  # -> simplify(graft(List))
cull_i_12 = CullIndex(List=crv_16, Indices="15", Wrap=True)  # -> simplify(graft(List))

debrep_19 = DeconstructBrep(Brep=extr_10)  # -> Faces, Edges, Vertices
debrep_20 = DeconstructBrep(Brep=extr_10)  # -> Faces, Edges, Vertices
item_19 = ListItem(List=debrep_19.Vertices, Index=Slider(5, range=0..10), Wrap=True)
item_20 = ListItem(List=debrep_20.Vertices, Index=Slider(4, range=0..10), Wrap=True)
merge_4 = Merge(Data1=item_19, Data2=item_20)
weave_4 = Weave(Pattern=[0, 1], Stream0=item_19, Stream1=item_20, NullGaps=False)
ln_4 = Line(StartPoint=item_19, EndPoint=item_20)
intcrv_7 = Interpolate(Vertices=flatten([item_20, item_19]), Degree=3, Periodic=False, KnotStyle=1)  # -> Curve, Length, Domain
Z_27 = UnitZ(Factor=Slider(0.9, range=0..1))
move_7 = Move(Geometry=intcrv_7.Curve, Motion=Z_27)  # -> Geometry, Transform
crv_30 = Curve(move_7.Geometry)
crv_31 = Curve(intcrv_7.Curve)
loft_12 = Loft(
    Curves=[crv_30, crv_31],
    Options=flatten({Adjust=False, Closed=False, LoftEnds=0, LoftSimp=0, LoftType=0, Rebuild=10, Refit=0.01}))

debrep_21 = DeconstructBrep(Brep=extr_10)  # -> Faces, Edges, Vertices
debrep_22 = DeconstructBrep(Brep=extr_10)  # -> Faces, Edges, Vertices
item_21 = ListItem(List=debrep_21.Vertices, Index=Slider(2, range=0..10), Wrap=True)
item_22 = ListItem(List=debrep_22.Vertices, Index=Slider(3, range=0..10), Wrap=True)
intcrv_8 = Interpolate(Vertices=flatten([item_22, item_21]), Degree=3, Periodic=False, KnotStyle=1)  # -> Curve, Length, Domain
Z_28 = UnitZ(Factor=Slider(0.9, range=0..1))
move_8 = Move(Geometry=intcrv_8.Curve, Motion=Z_28)  # -> Geometry, Transform
crv_32 = Curve(move_8.Geometry)
crv_33 = Curve(intcrv_8.Curve)
loft_13 = Loft(
    Curves=[crv_32, crv_33],
    Options=flatten({Adjust=False, Closed=False, LoftEnds=0, LoftSimp=0, LoftType=0, Rebuild=10, Refit=0.01}))

debrep_23 = DeconstructBrep(Brep=extr_11)  # -> Faces, Edges, Vertices
debrep_24 = DeconstructBrep(Brep=extr_11)  # -> Faces, Edges, Vertices
item_23 = ListItem(List=debrep_23.Vertices, Index=Slider(5, range=0..10), Wrap=True)
item_24 = ListItem(List=debrep_24.Vertices, Index=Slider(4, range=0..10), Wrap=True)
merge_5 = Merge(Data1=item_23, Data2=item_24)
weave_5 = Weave(Pattern=[0, 1], Stream0=item_23, Stream1=item_24, NullGaps=False)
ln_5 = Line(StartPoint=item_23, EndPoint=item_24)
intcrv_9 = Interpolate(Vertices=flatten([item_24, item_23]), Degree=3, Periodic=False, KnotStyle=1)  # -> Curve, Length, Domain
Z_29 = UnitZ(Factor=Slider(0.9, range=0..1))
move_9 = Move(Geometry=intcrv_9.Curve, Motion=Z_29)  # -> Geometry, Transform
crv_34 = Curve(move_9.Geometry)
crv_35 = Curve(intcrv_9.Curve)
loft_14 = Loft(
    Curves=[crv_34, crv_35],
    Options=flatten({Adjust=False, Closed=False, LoftEnds=0, LoftSimp=0, LoftType=0, Rebuild=10, Refit=0.01}))

debrep_25 = DeconstructBrep(Brep=extr_11)  # -> Faces, Edges, Vertices
debrep_26 = DeconstructBrep(Brep=extr_11)  # -> Faces, Edges, Vertices
item_25 = ListItem(List=debrep_25.Vertices, Index=Slider(2, range=0..10), Wrap=True)
item_26 = ListItem(List=debrep_26.Vertices, Index=Slider(3, range=0..10), Wrap=True)
intcrv_10 = Interpolate(Vertices=flatten([item_26, item_25]), Degree=3, Periodic=False, KnotStyle=1)  # -> Curve, Length, Domain
Z_30 = UnitZ(Factor=Slider(0.9, range=0..1))
move_10 = Move(Geometry=intcrv_10.Curve, Motion=Z_30)  # -> Geometry, Transform
crv_36 = Curve(move_10.Geometry)
crv_37 = Curve(intcrv_10.Curve)
loft_15 = Loft(
    Curves=[crv_36, crv_37],
    Options=flatten({Adjust=False, Closed=False, LoftEnds=0, LoftSimp=0, LoftType=0, Rebuild=10, Refit=0.01}))

panel_21 = Panel(cull_i_11)

debrep_27 = DeconstructBrep(Brep=extr_12)  # -> Faces, Edges, Vertices
debrep_28 = DeconstructBrep(Brep=extr_12)  # -> Faces, Edges, Vertices
item_27 = ListItem(List=debrep_27.Vertices, Index=Slider(5, range=0..10), Wrap=True)
item_28 = ListItem(List=debrep_28.Vertices, Index=Slider(4, range=0..10), Wrap=True)
merge_6 = Merge(Data1=item_27, Data2=item_28)
weave_6 = Weave(Pattern=[0, 1], Stream0=item_27, Stream1=item_28, NullGaps=False)
ln_6 = Line(StartPoint=item_27, EndPoint=item_28)
intcrv_11 = Interpolate(Vertices=flatten([item_28, item_27]), Degree=3, Periodic=False, KnotStyle=1)  # -> Curve, Length, Domain
Z_31 = UnitZ(Factor=Slider(0.9, range=0..1))
move_11 = Move(Geometry=intcrv_11.Curve, Motion=Z_31)  # -> Geometry, Transform
crv_38 = Curve(move_11.Geometry)
crv_39 = Curve(intcrv_11.Curve)
loft_16 = Loft(
    Curves=[crv_38, crv_39],
    Options=flatten({Adjust=False, Closed=False, LoftEnds=0, LoftSimp=0, LoftType=0, Rebuild=10, Refit=0.01}))

debrep_29 = DeconstructBrep(Brep=extr_12)  # -> Faces, Edges, Vertices
debrep_30 = DeconstructBrep(Brep=extr_12)  # -> Faces, Edges, Vertices
item_29 = ListItem(List=debrep_29.Vertices, Index=Slider(2, range=0..10), Wrap=True)
item_30 = ListItem(List=debrep_30.Vertices, Index=Slider(3, range=0..10), Wrap=True)
intcrv_12 = Interpolate(Vertices=flatten([item_30, item_29]), Degree=3, Periodic=False, KnotStyle=1)  # -> Curve, Length, Domain
Z_32 = UnitZ(Factor=Slider(0.9, range=0..1))
move_12 = Move(Geometry=intcrv_12.Curve, Motion=Z_32)  # -> Geometry, Transform
crv_40 = Curve(move_12.Geometry)
crv_41 = Curve(intcrv_12.Curve)
loft_17 = Loft(
    Curves=[crv_40, crv_41],
    Options=flatten({Adjust=False, Closed=False, LoftEnds=0, LoftSimp=0, LoftType=0, Rebuild=10, Refit=0.01}))

panel_22 = Panel(cull_i_12)

debrep_31 = DeconstructBrep(Brep=extr_13)  # -> Faces, Edges, Vertices
debrep_32 = DeconstructBrep(Brep=extr_13)  # -> Faces, Edges, Vertices
item_31 = ListItem(List=debrep_31.Vertices, Index=Slider(5, range=0..10), Wrap=True)
item_32 = ListItem(List=debrep_32.Vertices, Index=Slider(4, range=0..10), Wrap=True)
merge_7 = Merge(Data1=item_31, Data2=item_32)
weave_7 = Weave(Pattern=[0, 1], Stream0=item_31, Stream1=item_32, NullGaps=False)
ln_7 = Line(StartPoint=item_31, EndPoint=item_32)
intcrv_13 = Interpolate(Vertices=flatten([item_32, item_31]), Degree=3, Periodic=False, KnotStyle=1)  # -> Curve, Length, Domain
Z_33 = UnitZ(Factor=Slider(0.9, range=0..1))
move_13 = Move(Geometry=intcrv_13.Curve, Motion=Z_33)  # -> Geometry, Transform
crv_42 = Curve(move_13.Geometry)
crv_43 = Curve(intcrv_13.Curve)
loft_18 = Loft(
    Curves=[crv_42, crv_43],
    Options=flatten({Adjust=False, Closed=False, LoftEnds=0, LoftSimp=0, LoftType=0, Rebuild=10, Refit=0.01}))

debrep_33 = DeconstructBrep(Brep=extr_13)  # -> Faces, Edges, Vertices
debrep_34 = DeconstructBrep(Brep=extr_13)  # -> Faces, Edges, Vertices
item_33 = ListItem(List=debrep_33.Vertices, Index=Slider(2, range=0..10), Wrap=True)
item_34 = ListItem(List=debrep_34.Vertices, Index=Slider(3, range=0..10), Wrap=True)
intcrv_14 = Interpolate(Vertices=flatten([item_34, item_33]), Degree=3, Periodic=False, KnotStyle=1)  # -> Curve, Length, Domain
Z_34 = UnitZ(Factor=Slider(0.9, range=0..1))
move_14 = Move(Geometry=intcrv_14.Curve, Motion=Z_34)  # -> Geometry, Transform
crv_44 = Curve(move_14.Geometry)
crv_45 = Curve(intcrv_14.Curve)
loft_19 = Loft(
    Curves=[crv_44, crv_45],
    Options=flatten({Adjust=False, Closed=False, LoftEnds=0, LoftSimp=0, LoftType=0, Rebuild=10, Refit=0.01}))

flip_15 = FlipCurve(Curve=cull_i_12)  # -> Curve, Flag

debrep_35 = DeconstructBrep(Brep=extr_14)  # -> Faces, Edges, Vertices
debrep_36 = DeconstructBrep(Brep=extr_14)  # -> Faces, Edges, Vertices
item_35 = ListItem(List=debrep_35.Vertices, Index=Slider(5, range=0..10), Wrap=True)
item_36 = ListItem(List=debrep_36.Vertices, Index=Slider(4, range=0..10), Wrap=True)
merge_8 = Merge(Data1=item_35, Data2=item_36)
weave_8 = Weave(Pattern=[0, 1], Stream0=item_35, Stream1=item_36, NullGaps=False)
ln_8 = Line(StartPoint=item_35, EndPoint=item_36)
intcrv_15 = Interpolate(Vertices=flatten([item_36, item_35]), Degree=3, Periodic=False, KnotStyle=1)  # -> Curve, Length, Domain
Z_35 = UnitZ(Factor=Slider(0.9, range=0..1))
move_15 = Move(Geometry=intcrv_15.Curve, Motion=Z_35)  # -> Geometry, Transform
crv_46 = Curve(move_15.Geometry)
crv_47 = Curve(intcrv_15.Curve)
loft_20 = Loft(
    Curves=[crv_46, crv_47],
    Options=flatten({Adjust=False, Closed=False, LoftEnds=0, LoftSimp=0, LoftType=0, Rebuild=10, Refit=0.01}))

debrep_37 = DeconstructBrep(Brep=extr_14)  # -> Faces, Edges, Vertices
debrep_38 = DeconstructBrep(Brep=extr_14)  # -> Faces, Edges, Vertices
item_37 = ListItem(List=debrep_37.Vertices, Index=Slider(2, range=0..10), Wrap=True)
item_38 = ListItem(List=debrep_38.Vertices, Index=Slider(3, range=0..10), Wrap=True)
intcrv_16 = Interpolate(Vertices=flatten([item_38, item_37]), Degree=3, Periodic=False, KnotStyle=1)  # -> Curve, Length, Domain
Z_36 = UnitZ(Factor=Slider(0.9, range=0..1))
move_16 = Move(Geometry=intcrv_16.Curve, Motion=Z_36)  # -> Geometry, Transform
crv_48 = Curve(move_16.Geometry)
crv_49 = Curve(intcrv_16.Curve)
loft_21 = Loft(
    Curves=[crv_48, crv_49],
    Options=flatten({Adjust=False, Closed=False, LoftEnds=0, LoftSimp=0, LoftType=0, Rebuild=10, Refit=0.01}))

debrep_39 = DeconstructBrep(Brep=extr_15)  # -> Faces, Edges, Vertices
debrep_40 = DeconstructBrep(Brep=extr_15)  # -> Faces, Edges, Vertices
item_39 = ListItem(List=debrep_39.Vertices, Index=Slider(5, range=0..10), Wrap=True)
item_40 = ListItem(List=debrep_40.Vertices, Index=Slider(4, range=0..10), Wrap=True)
merge_9 = Merge(Data1=item_39, Data2=item_40)
weave_9 = Weave(Pattern=[0, 1], Stream0=item_39, Stream1=item_40, NullGaps=False)
ln_9 = Line(StartPoint=item_39, EndPoint=item_40)
intcrv_17 = Interpolate(Vertices=flatten([item_40, item_39]), Degree=3, Periodic=False, KnotStyle=1)  # -> Curve, Length, Domain
Z_37 = UnitZ(Factor=Slider(0.9, range=0..1))
move_17 = Move(Geometry=intcrv_17.Curve, Motion=Z_37)  # -> Geometry, Transform
crv_50 = Curve(move_17.Geometry)
crv_51 = Curve(intcrv_17.Curve)
loft_22 = Loft(
    Curves=[crv_50, crv_51],
    Options=flatten({Adjust=False, Closed=False, LoftEnds=0, LoftSimp=0, LoftType=0, Rebuild=10, Refit=0.01}))

debrep_41 = DeconstructBrep(Brep=extr_15)  # -> Faces, Edges, Vertices
debrep_42 = DeconstructBrep(Brep=extr_15)  # -> Faces, Edges, Vertices
item_41 = ListItem(List=debrep_41.Vertices, Index=Slider(2, range=0..10), Wrap=True)
item_42 = ListItem(List=debrep_42.Vertices, Index=Slider(3, range=0..10), Wrap=True)
intcrv_18 = Interpolate(Vertices=flatten([item_42, item_41]), Degree=3, Periodic=False, KnotStyle=1)  # -> Curve, Length, Domain
Z_38 = UnitZ(Factor=Slider(0.9, range=0..1))
move_18 = Move(Geometry=intcrv_18.Curve, Motion=Z_38)  # -> Geometry, Transform
crv_52 = Curve(move_18.Geometry)
crv_53 = Curve(intcrv_18.Curve)
loft_23 = Loft(
    Curves=[crv_52, crv_53],
    Options=flatten({Adjust=False, Closed=False, LoftEnds=0, LoftSimp=0, LoftType=0, Rebuild=10, Refit=0.01}))

crv_54 = Curve([flip_15.Curve, cull_i_11])
panel_23 = Panel(crv_54)
loft_24 = Loft(Curves=crv_54, Options={Adjust=False, Closed=False, LoftEnds=0, LoftSimp=0, LoftType=0, Rebuild=10, Refit=0.01})
panel_24 = Panel(cull_i_12)  # disabled
Z_39 = UnitZ(Factor=Slider(0.3, range=0..5))
extr_16 = Extrude(Base=loft_24, Direction=Z_39)
Y = UnitY(Factor=Slider(0.03, range=0..5))
Y_2 = UnitY(Factor=Slider(0.03, range=0..5))
debrep_43 = DeconstructBrep(Brep=loft_6)  # -> Faces, Edges, Vertices
Y_3 = UnitY(Factor=Slider(0.03, range=0..5))
Y_4 = UnitY(Factor=Slider(0.03, range=0..5))
debrep_44 = DeconstructBrep(Brep=loft_8)  # -> Faces, Edges, Vertices
Y_5 = UnitY(Factor=Slider(0.03, range=0..5))
extr_17 = Extrude(Base=loft_6, Direction=Y)
Y_6 = UnitY(Factor=Slider(0.03, range=0..5))
extr_18 = Extrude(Base=loft_7, Direction=Y_2)
debrep_45 = DeconstructBrep(Brep=extr_18)  # -> Faces, Edges, Vertices
debrep_46 = DeconstructBrep(Brep=loft_10)  # -> Faces, Edges, Vertices

debrep_47 = DeconstructBrep(Brep=extr_16)  # -> Faces, Edges, Vertices
debrep_48 = DeconstructBrep(Brep=extr_16)  # -> Faces, Edges, Vertices
item_43 = ListItem(List=debrep_47.Vertices, Index=Slider(5, range=0..10), Wrap=True)
item_44 = ListItem(List=debrep_48.Vertices, Index=Slider(4, range=0..10), Wrap=True)
merge_10 = Merge(Data1=item_43, Data2=item_44)
weave_10 = Weave(Pattern=[0, 1], Stream0=item_43, Stream1=item_44, NullGaps=False)
ln_10 = Line(StartPoint=item_43, EndPoint=item_44)
intcrv_19 = Interpolate(Vertices=flatten([item_44, item_43]), Degree=3, Periodic=False, KnotStyle=1)  # -> Curve, Length, Domain
Z_40 = UnitZ(Factor=Slider(0.9, range=0..1))
move_19 = Move(Geometry=intcrv_19.Curve, Motion=Z_40)  # -> Geometry, Transform
crv_55 = Curve(move_19.Geometry)
crv_56 = Curve(intcrv_19.Curve)
loft_25 = Loft(
    Curves=[crv_55, crv_56],
    Options=flatten({Adjust=False, Closed=False, LoftEnds=0, LoftSimp=0, LoftType=0, Rebuild=10, Refit=0.01}))

debrep_49 = DeconstructBrep(Brep=extr_16)  # -> Faces, Edges, Vertices
debrep_50 = DeconstructBrep(Brep=extr_16)  # -> Faces, Edges, Vertices
item_45 = ListItem(List=debrep_49.Vertices, Index=Slider(2, range=0..10), Wrap=True)
item_46 = ListItem(List=debrep_50.Vertices, Index=Slider(3, range=0..10), Wrap=True)
intcrv_20 = Interpolate(Vertices=flatten([item_46, item_45]), Degree=3, Periodic=False, KnotStyle=1)  # -> Curve, Length, Domain
Z_41 = UnitZ(Factor=Slider(0.9, range=0..1))
move_20 = Move(Geometry=intcrv_20.Curve, Motion=Z_41)  # -> Geometry, Transform
crv_57 = Curve(move_20.Geometry)
crv_58 = Curve(intcrv_20.Curve)
loft_26 = Loft(
    Curves=[crv_57, crv_58],
    Options=flatten({Adjust=False, Closed=False, LoftEnds=0, LoftSimp=0, LoftType=0, Rebuild=10, Refit=0.01}))

extr_19 = Extrude(Base=loft_8, Direction=Y_3)
extr_20 = Extrude(Base=loft_9, Direction=Y_4)
debrep_51 = DeconstructBrep(Brep=extr_20)  # -> Faces, Edges, Vertices

truss = _2DTruss(CurveA=crv_17, CurveB=crv_18, Divisions=Slider(20, range=0..100), TrussToggle=0)  # -> PrimaryLines, BraceLines, VerticalLines, StructureNodes
crv_59 = Curve(truss.PrimaryLines)
crv_60 = Curve(truss.VerticalLines)
cluster_6 = Cluster_3(curvepoint_2=crv_59, crv=truss.BraceLines, curvepoint=crv_60, L=[crv_60, crv_59])  # -> I, number_slider_2, crv_4
mp = MultiPipe(
    Curves=[crv_19, crv_20, cluster_6.crv_4],
    NodeSize=cluster_6.I,
    EndOffset=1,
    StrutSize=cluster_6.number_slider_2,
    Segment=0,
    KinkAngle=0.6,
    CubeFit=0,
    Caps=0)

Y_7 = UnitY(Factor=Slider(0.03, range=0..5))
extr_21 = Extrude(Base=loft_10, Direction=Y_5)
Y_8 = UnitY(Factor=Slider(0.03, range=0..5))
Y_9 = UnitY(Factor=Slider(0.03, range=0..5))
extr_22 = Extrude(Base=loft_11, Direction=Y_6)
debrep_52 = DeconstructBrep(Brep=extr_22)  # -> Faces, Edges, Vertices
Y_10 = UnitY(Factor=Slider(0.03, range=0..5))
debrep_53 = DeconstructBrep(Brep=loft_12)  # -> Faces, Edges, Vertices
debrep_54 = DeconstructBrep(Brep=loft_14)  # -> Faces, Edges, Vertices
Y_11 = UnitY(Factor=Slider(0.03, range=0..5))
volume = Volume(Geometry=extr_17)  # -> Volume, Centroid

truss_2 = _2DTruss(CurveA=crv_22, CurveB=crv_23, Divisions=Slider(20, range=0..100), TrussToggle=0)  # -> PrimaryLines, BraceLines, VerticalLines, StructureNodes
crv_61 = Curve(truss_2.PrimaryLines)
crv_62 = Curve(truss_2.VerticalLines)
cluster_7 = Cluster_3(curvepoint_2=crv_61, crv=truss_2.BraceLines, curvepoint=crv_62, L=[crv_62, crv_61])  # -> I, number_slider_2, crv_4
mp_2 = MultiPipe(
    Curves=[crv_24, crv_25, cluster_7.crv_4],
    NodeSize=cluster_7.I,
    EndOffset=1,
    StrutSize=cluster_7.number_slider_2,
    Segment=0,
    KinkAngle=0.6,
    CubeFit=0,
    Caps=0)

Y_12 = UnitY(Factor=Slider(0.03, range=0..5))
Y_13 = UnitY(Factor=Slider(0.03, range=0..5))
Y_14 = UnitY(Factor=Slider(0.03, range=0..5))
debrep_55 = DeconstructBrep(Brep=loft_16)  # -> Faces, Edges, Vertices
Y_15 = UnitY(Factor=Slider(0.03, range=0..5))
Y_16 = UnitY(Factor=Slider(0.03, range=0..5))
Y_17 = UnitY(Factor=Slider(0.03, range=0..5))
debrep_56 = DeconstructBrep(Brep=loft_18)  # -> Faces, Edges, Vertices

truss_3 = _2DTruss(CurveA=crv_26, CurveB=crv_27, Divisions=Slider(20, range=0..100), TrussToggle=0)  # -> PrimaryLines, BraceLines, VerticalLines, StructureNodes
crv_63 = Curve(truss_3.PrimaryLines)
crv_64 = Curve(truss_3.VerticalLines)
cluster_8 = Cluster_3(curvepoint_2=crv_63, crv=truss_3.BraceLines, curvepoint=crv_64, L=[crv_64, crv_63])  # -> I, number_slider_2, crv_4
mp_3 = MultiPipe(
    Curves=[crv_28, crv_29, cluster_8.crv_4],
    NodeSize=cluster_8.I,
    EndOffset=1,
    StrutSize=cluster_8.number_slider_2,
    Segment=0,
    KinkAngle=0.6,
    CubeFit=0,
    Caps=0)

debrep_57 = DeconstructBrep(Brep=loft_20)  # -> Faces, Edges, Vertices
volume_2 = Volume(Geometry=extr_19)  # -> Volume, Centroid
extr_23 = Extrude(Base=loft_12, Direction=Y_7)
Y_18 = UnitY(Factor=Slider(0.03, range=0..5))
extr_24 = Extrude(Base=loft_14, Direction=Y_8)
extr_25 = Extrude(Base=loft_13, Direction=Y_9)
debrep_58 = DeconstructBrep(Brep=extr_25)  # -> Faces, Edges, Vertices
debrep_59 = DeconstructBrep(Brep=loft_22)  # -> Faces, Edges, Vertices
extr_26 = Extrude(Base=loft_15, Direction=Y_10)
debrep_60 = DeconstructBrep(Brep=extr_26)  # -> Faces, Edges, Vertices
extr_27 = Extrude(Base=loft_16, Direction=Y_11)
volume_3 = Volume(Geometry=extr_21)  # -> Volume, Centroid
extr_28 = Extrude(Base=loft_17, Direction=Y_12)
debrep_61 = DeconstructBrep(Brep=extr_28)  # -> Faces, Edges, Vertices

truss_4 = _2DTruss(CurveA=crv_19, CurveB=crv_20, Divisions=Slider(20, range=0..100), TrussToggle=0)  # -> PrimaryLines, BraceLines, VerticalLines, StructureNodes
crv_65 = Curve(truss_4.PrimaryLines)
crv_66 = Curve(truss_4.VerticalLines)
cluster_9 = Cluster_3(curvepoint_2=crv_65, crv=truss_4.BraceLines, curvepoint=crv_66, L=[crv_66, crv_65])  # -> I, number_slider_2, crv_4
mp_4 = MultiPipe(
    Curves=[crv_19, crv_20, cluster_9.crv_4],
    NodeSize=cluster_9.I,
    EndOffset=1,
    StrutSize=cluster_9.number_slider_2,
    Segment=0,
    KinkAngle=0.6,
    CubeFit=0,
    Caps=0)

extr_29 = Extrude(Base=loft_18, Direction=Y_13)
extr_30 = Extrude(Base=loft_20, Direction=Y_14)
extr_31 = Extrude(Base=loft_19, Direction=Y_15)
debrep_62 = DeconstructBrep(Brep=extr_31)  # -> Faces, Edges, Vertices
extr_32 = Extrude(Base=loft_21, Direction=Y_16)
debrep_63 = DeconstructBrep(Brep=extr_32)  # -> Faces, Edges, Vertices
extr_33 = Extrude(Base=loft_22, Direction=Y_17)

truss_5 = _2DTruss(CurveA=crv_30, CurveB=crv_31, Divisions=Slider(20, range=0..100), TrussToggle=0)  # -> PrimaryLines, BraceLines, VerticalLines, StructureNodes
crv_67 = Curve(truss_5.PrimaryLines)
crv_68 = Curve(truss_5.VerticalLines)
cluster_10 = Cluster_3(curvepoint_2=crv_67, crv=truss_5.BraceLines, curvepoint=crv_68, L=[crv_68, crv_67])  # -> I, number_slider_2, crv_4
mp_5 = MultiPipe(
    Curves=[crv_32, crv_33, cluster_10.crv_4],
    NodeSize=cluster_10.I,
    EndOffset=1,
    StrutSize=cluster_10.number_slider_2,
    Segment=0,
    KinkAngle=0.6,
    CubeFit=0,
    Caps=0)

truss_6 = _2DTruss(CurveA=crv_34, CurveB=crv_35, Divisions=Slider(27, range=0..100), TrussToggle=0)  # -> PrimaryLines, BraceLines, VerticalLines, StructureNodes
crv_69 = Curve(truss_6.PrimaryLines)
crv_70 = Curve(truss_6.VerticalLines)
cluster_11 = Cluster_3(curvepoint_2=crv_69, crv=truss_6.BraceLines, curvepoint=crv_70, L=[crv_70, crv_69])  # -> I, number_slider_2, crv_4
mp_6 = MultiPipe(
    Curves=[crv_36, crv_37, cluster_11.crv_4],
    NodeSize=cluster_11.I,
    EndOffset=1,
    StrutSize=cluster_11.number_slider_2,
    Segment=0,
    KinkAngle=0.6,
    CubeFit=0,
    Caps=0)

extr_34 = Extrude(Base=loft_23, Direction=Y_18)
debrep_64 = DeconstructBrep(Brep=extr_34)  # -> Faces, Edges, Vertices

truss_7 = _2DTruss(CurveA=crv_24, CurveB=crv_25, Divisions=Slider(20, range=0..100), TrussToggle=0)  # -> PrimaryLines, BraceLines, VerticalLines, StructureNodes
crv_71 = Curve(truss_7.PrimaryLines)
crv_72 = Curve(truss_7.VerticalLines)
cluster_12 = Cluster_3(curvepoint_2=crv_71, crv=truss_7.BraceLines, curvepoint=crv_72, L=[crv_72, crv_71])  # -> I, number_slider_2, crv_4
mp_7 = MultiPipe(
    Curves=[crv_24, crv_25, cluster_12.crv_4],
    NodeSize=cluster_12.I,
    EndOffset=1,
    StrutSize=cluster_12.number_slider_2,
    Segment=0,
    KinkAngle=0.6,
    CubeFit=0,
    Caps=0)

truss_8 = _2DTruss(CurveA=crv_38, CurveB=crv_39, Divisions=Slider(27, range=0..100), TrussToggle=0)  # -> PrimaryLines, BraceLines, VerticalLines, StructureNodes
crv_73 = Curve(truss_8.PrimaryLines)
crv_74 = Curve(truss_8.VerticalLines)
cluster_13 = Cluster_3(curvepoint_2=crv_73, crv=truss_8.BraceLines, curvepoint=crv_74, L=[crv_74, crv_73])  # -> I, number_slider_2, crv_4
mp_8 = MultiPipe(
    Curves=[crv_40, crv_41, cluster_13.crv_4],
    NodeSize=cluster_13.I,
    EndOffset=1,
    StrutSize=cluster_13.number_slider_2,
    Segment=0,
    KinkAngle=0.6,
    CubeFit=0,
    Caps=0)

volume_4 = Volume(Geometry=extr_23)  # -> Volume, Centroid

truss_9 = _2DTruss(CurveA=crv_42, CurveB=crv_43, Divisions=Slider(27, range=0..100), TrussToggle=0)  # -> PrimaryLines, BraceLines, VerticalLines, StructureNodes
crv_75 = Curve(truss_9.PrimaryLines)
crv_76 = Curve(truss_9.VerticalLines)
cluster_14 = Cluster_3(curvepoint_2=crv_75, crv=truss_9.BraceLines, curvepoint=crv_76, L=[crv_76, crv_75])  # -> I, number_slider_2, crv_4
mp_9 = MultiPipe(
    Curves=[crv_44, crv_45, cluster_14.crv_4],
    NodeSize=cluster_14.I,
    EndOffset=1,
    StrutSize=cluster_14.number_slider_2,
    Segment=0,
    KinkAngle=0.6,
    CubeFit=0,
    Caps=0)

volume_5 = Volume(Geometry=extr_24)  # -> Volume, Centroid

truss_10 = _2DTruss(CurveA=crv_46, CurveB=crv_47, Divisions=Slider(40, range=0..100), TrussToggle=0)  # -> PrimaryLines, BraceLines, VerticalLines, StructureNodes
crv_77 = Curve(truss_10.PrimaryLines)
crv_78 = Curve(truss_10.VerticalLines)
cluster_15 = Cluster_3(curvepoint_2=crv_77, crv=truss_10.BraceLines, curvepoint=crv_78, L=[crv_78, crv_77])  # -> I, number_slider_2, crv_4
mp_10 = MultiPipe(
    Curves=[crv_48, crv_49, cluster_15.crv_4],
    NodeSize=cluster_15.I,
    EndOffset=1,
    StrutSize=cluster_15.number_slider_2,
    Segment=0,
    KinkAngle=0.6,
    CubeFit=0,
    Caps=0)

truss_11 = _2DTruss(CurveA=crv_28, CurveB=crv_29, Divisions=Slider(20, range=0..100), TrussToggle=0)  # -> PrimaryLines, BraceLines, VerticalLines, StructureNodes
crv_79 = Curve(truss_11.PrimaryLines)
crv_80 = Curve(truss_11.VerticalLines)
cluster_16 = Cluster_3(curvepoint_2=crv_79, crv=truss_11.BraceLines, curvepoint=crv_80, L=[crv_80, crv_79])  # -> I, number_slider_2, crv_4
mp_11 = MultiPipe(
    Curves=[crv_28, crv_29, cluster_16.crv_4],
    NodeSize=cluster_16.I,
    EndOffset=1,
    StrutSize=cluster_16.number_slider_2,
    Segment=0,
    KinkAngle=0.6,
    CubeFit=0,
    Caps=0)

truss_12 = _2DTruss(CurveA=crv_50, CurveB=crv_51, Divisions=Slider(27, range=0..100), TrussToggle=0)  # -> PrimaryLines, BraceLines, VerticalLines, StructureNodes
crv_81 = Curve(truss_12.PrimaryLines)
crv_82 = Curve(truss_12.VerticalLines)
cluster_17 = Cluster_3(curvepoint_2=crv_81, crv=truss_12.BraceLines, curvepoint=crv_82, L=[crv_82, crv_81])  # -> I, number_slider_2, crv_4
mp_12 = MultiPipe(
    Curves=[crv_52, crv_53, cluster_17.crv_4],
    NodeSize=cluster_17.I,
    EndOffset=1,
    StrutSize=cluster_17.number_slider_2,
    Segment=0,
    KinkAngle=0.6,
    CubeFit=0,
    Caps=0)

volume_6 = Volume(Geometry=extr_27)  # -> Volume, Centroid
volume_7 = Volume(Geometry=extr_29)  # -> Volume, Centroid
volume_8 = Volume(Geometry=extr_30)  # -> Volume, Centroid
volume_9 = Volume(Geometry=extr_33)  # -> Volume, Centroid

truss_13 = _2DTruss(CurveA=crv_32, CurveB=crv_33, Divisions=Slider(20, range=0..100), TrussToggle=0)  # -> PrimaryLines, BraceLines, VerticalLines, StructureNodes
crv_83 = Curve(truss_13.PrimaryLines)
crv_84 = Curve(truss_13.VerticalLines)
cluster_18 = Cluster_3(curvepoint_2=crv_83, crv=truss_13.BraceLines, curvepoint=crv_84, L=[crv_84, crv_83])  # -> I, number_slider_2, crv_4
mp_13 = MultiPipe(
    Curves=[crv_32, crv_33, cluster_18.crv_4],
    NodeSize=cluster_18.I,
    EndOffset=1,
    StrutSize=cluster_18.number_slider_2,
    Segment=0,
    KinkAngle=0.6,
    CubeFit=0,
    Caps=0)

truss_14 = _2DTruss(CurveA=crv_36, CurveB=crv_37, Divisions=Slider(27, range=0..100), TrussToggle=0)  # -> PrimaryLines, BraceLines, VerticalLines, StructureNodes
crv_85 = Curve(truss_14.PrimaryLines)
crv_86 = Curve(truss_14.VerticalLines)
cluster_19 = Cluster_3(curvepoint_2=crv_85, crv=truss_14.BraceLines, curvepoint=crv_86, L=[crv_86, crv_85])  # -> I, number_slider_2, crv_4
mp_14 = MultiPipe(
    Curves=[crv_36, crv_37, cluster_19.crv_4],
    NodeSize=cluster_19.I,
    EndOffset=1,
    StrutSize=cluster_19.number_slider_2,
    Segment=0,
    KinkAngle=0.6,
    CubeFit=0,
    Caps=0)

truss_15 = _2DTruss(CurveA=crv_40, CurveB=crv_41, Divisions=Slider(27, range=0..100), TrussToggle=0)  # -> PrimaryLines, BraceLines, VerticalLines, StructureNodes
crv_87 = Curve(truss_15.PrimaryLines)
crv_88 = Curve(truss_15.VerticalLines)
cluster_20 = Cluster_3(curvepoint_2=crv_87, crv=truss_15.BraceLines, curvepoint=crv_88, L=[crv_88, crv_87])  # -> I, number_slider_2, crv_4
mp_15 = MultiPipe(
    Curves=[crv_40, crv_41, cluster_20.crv_4],
    NodeSize=cluster_20.I,
    EndOffset=1,
    StrutSize=cluster_20.number_slider_2,
    Segment=0,
    KinkAngle=0.6,
    CubeFit=0,
    Caps=0)

truss_16 = _2DTruss(CurveA=crv_44, CurveB=crv_45, Divisions=Slider(27, range=0..100), TrussToggle=0)  # -> PrimaryLines, BraceLines, VerticalLines, StructureNodes
crv_89 = Curve(truss_16.PrimaryLines)
crv_90 = Curve(truss_16.VerticalLines)
cluster_21 = Cluster_3(curvepoint_2=crv_89, crv=truss_16.BraceLines, curvepoint=crv_90, L=[crv_90, crv_89])  # -> I, number_slider_2, crv_4
mp_16 = MultiPipe(
    Curves=[crv_44, crv_45, cluster_21.crv_4],
    NodeSize=cluster_21.I,
    EndOffset=1,
    StrutSize=cluster_21.number_slider_2,
    Segment=0,
    KinkAngle=0.6,
    CubeFit=0,
    Caps=0)

truss_17 = _2DTruss(CurveA=crv_48, CurveB=crv_49, Divisions=Slider(20, range=0..100), TrussToggle=0)  # -> PrimaryLines, BraceLines, VerticalLines, StructureNodes
crv_91 = Curve(truss_17.PrimaryLines)
crv_92 = Curve(truss_17.VerticalLines)
cluster_22 = Cluster_3(curvepoint_2=crv_91, crv=truss_17.BraceLines, curvepoint=crv_92, L=[crv_92, crv_91])  # -> I, number_slider_2, crv_4
mp_17 = MultiPipe(
    Curves=[crv_48, crv_49, cluster_22.crv_4],
    NodeSize=cluster_22.I,
    EndOffset=1,
    StrutSize=cluster_22.number_slider_2,
    Segment=0,
    KinkAngle=0.6,
    CubeFit=0,
    Caps=0)

truss_18 = _2DTruss(CurveA=crv_52, CurveB=crv_53, Divisions=Slider(27, range=0..100), TrussToggle=0)  # -> PrimaryLines, BraceLines, VerticalLines, StructureNodes
crv_93 = Curve(truss_18.PrimaryLines)
crv_94 = Curve(truss_18.VerticalLines)
cluster_23 = Cluster_3(curvepoint_2=crv_93, crv=truss_18.BraceLines, curvepoint=crv_94, L=[crv_94, crv_93])  # -> I, number_slider_2, crv_4
mp_18 = MultiPipe(
    Curves=[crv_52, crv_53, cluster_23.crv_4],
    NodeSize=cluster_23.I,
    EndOffset=1,
    StrutSize=cluster_23.number_slider_2,
    Segment=0,
    KinkAngle=0.6,
    CubeFit=0,
    Caps=0)

Y_19 = UnitY(Factor=Slider(0.03, range=0..5))
Y_20 = UnitY(Factor=Slider(0.03, range=0..5))
debrep_65 = DeconstructBrep(Brep=loft_25)  # -> Faces, Edges, Vertices
extr_35 = Extrude(Base=loft_25, Direction=Y_19)
extr_36 = Extrude(Base=loft_26, Direction=Y_20)
debrep_66 = DeconstructBrep(Brep=extr_36)  # -> Faces, Edges, Vertices

truss_19 = _2DTruss(CurveA=crv_55, CurveB=crv_56, Divisions=Slider(27, range=0..100), TrussToggle=0)  # -> PrimaryLines, BraceLines, VerticalLines, StructureNodes
crv_95 = Curve(truss_19.PrimaryLines)
crv_96 = Curve(truss_19.VerticalLines)
cluster_24 = Cluster_3(curvepoint_2=crv_95, crv=truss_19.BraceLines, curvepoint=crv_96, L=[crv_96, crv_95])  # -> I, number_slider_2, crv_4
mp_19 = MultiPipe(
    Curves=[crv_57, crv_58, cluster_24.crv_4],
    NodeSize=cluster_24.I,
    EndOffset=1,
    StrutSize=cluster_24.number_slider_2,
    Segment=0,
    KinkAngle=0.6,
    CubeFit=0,
    Caps=0)

volume_10 = Volume(Geometry=extr_35)  # -> Volume, Centroid

truss_20 = _2DTruss(CurveA=crv_57, CurveB=crv_58, Divisions=Slider(27, range=0..100), TrussToggle=0)  # -> PrimaryLines, BraceLines, VerticalLines, StructureNodes
crv_97 = Curve(truss_20.PrimaryLines)
crv_98 = Curve(truss_20.VerticalLines)
cluster_25 = Cluster_2(curvepoint=crv_97, crv=truss_20.BraceLines, curvepoint_2=crv_98, L=[crv_98, crv_97])  # -> I, number_slider_2, crv_4
mp_20 = MultiPipe(
    Curves=[crv_57, crv_58, cluster_25.crv_4],
    NodeSize=cluster_25.I,
    EndOffset=1,
    StrutSize=cluster_25.number_slider_2,
    Segment=0,
    KinkAngle=0.6,
    CubeFit=0,
    Caps=0)

number_slider_12 = Slider(50, range=0..100)  # disabled

number_slider_13 = Slider(1000, range=0..5000)  # disabled
number_slider_14 = Slider(1000, range=0..5000)  # disabled
number_slider_15 = Slider(1000, range=0..5000)  # disabled
rectangle = Rectangle(Plane=PlaneXY(0, 0, 0), XSize=number_slider_13, YSize=number_slider_14, Radius=0)  # -> Rectangle, Length; disabled
Z_42 = UnitZ(Factor=number_slider_15)  # disabled
extr_37 = Extrude(Base=rectangle.Rectangle, Direction=Z_42)  # disabled
cap = CapHoles(Brep=extr_37)  # disabled

subd = SubD(<subd referenced from the Rhino model>)  # disabled
number_slider_16 = Slider(0.9, range=0..1)  # disabled
number_slider_17 = Slider(0.9, range=0..1)  # disabled
volume_11 = Volume(Geometry=cap)  # -> Volume, Centroid; disabled
volume_12 = Volume(Geometry=subd)  # -> Volume, Centroid; disabled
number_slider_18 = Slider(50, range=0..100)  # disabled
scale = Scale(Geometry=cap, Center=volume_11.Centroid, Factor=number_slider_16)  # -> Geometry, Transform; disabled
scale_2 = Scale(Geometry=subd, Center=volume_12.Centroid, Factor=number_slider_17)  # -> Geometry, Transform; disabled
pop3d = Populate3D(Region=extr_37, Count=number_slider_12, Seed=1)  # disabled
pop3d_2 = Populate3D(Region=subd, Count=number_slider_18, Seed=1)  # disabled
voronoi³ = Voronoi3D(Points=pop3d)  # -> Cells, Boundary; disabled
voronoi³_2 = Voronoi3D(Points=pop3d_2)  # -> Cells, Boundary; disabled
volume_13 = Volume(Geometry=voronoi³.Cells)  # -> Volume, Centroid; disabled
volume_14 = Volume(Geometry=voronoi³_2.Cells)  # -> Volume, Centroid; disabled
scale_3 = Scale(Geometry=voronoi³.Cells, Center=volume_13.Centroid, Factor=number_slider_16)  # -> Geometry, Transform; disabled
scale_4 = Scale(Geometry=voronoi³_2.Cells, Center=volume_14.Centroid, Factor=number_slider_17)  # -> Geometry, Transform; disabled
sdiff = SolidDifference(BrepsA=scale.Geometry, BrepsB=scale_3.Geometry)  # disabled
sdiff_2 = SolidDifference(BrepsA=scale_2.Geometry, BrepsB=scale_4.Geometry)  # disabled
debrep_67 = DeconstructBrep(Brep=sdiff)  # -> Faces, Edges, Vertices; disabled
debrep_68 = DeconstructBrep(Brep=sdiff_2)  # -> Faces, Edges, Vertices; disabled
mesh = MeshBrep(
    Brep=debrep_67.Faces,
    Settings={GridMaxCount=0, GridMinCount=16, JaggedSeams=False, MaxEdgeLength=0, MinEdgeLength=0.0001, MinTolerance=0, Refine=True, RefineAngle=0, RelativeTolerance=0.65, SimplePlanes=True, Tolerance=0})  # disabled
mesh_2 = MeshBrep(
    Brep=debrep_68.Faces,
    Settings={GridMaxCount=0, GridMinCount=16, JaggedSeams=False, MaxEdgeLength=0, MinEdgeLength=0.0001, MinTolerance=0, Refine=True, RefineAngle=0, RelativeTolerance=0.65, SimplePlanes=True, Tolerance=0})  # disabled
number_slider_19 = Slider(3, range=0..10)  # disabled
number_slider_20 = Slider(3, range=0..10)  # disabled
mjoin = MeshJoin(Meshes=mesh)  # disabled
mjoin_2 = MeshJoin(Meshes=mesh_2)  # disabled
number_slider_21 = Slider(2000, range=0..5000)  # disabled
number_slider_22 = Slider(80, range=0..5000)  # disabled
number_slider_23 = Slider(2000, range=0..5000)  # disabled
number_slider_24 = Slider(20, range=0..5000)  # disabled
wbcatmullclark = WeaverbirdsCatmullClarkSubdivision(MeshCurves=mjoin, Level=number_slider_19, SmoothNakedEdges=1)  # disabled
wbcatmullclark_2 = WeaverbirdsCatmullClarkSubdivision(MeshCurves=mjoin_2, Level=number_slider_20, SmoothNakedEdges=1)  # disabled
division_7 = Division(A=number_slider_21, B=number_slider_22)  # disabled
X = UnitX(Factor=1)  # disabled
division_8 = Division(A=number_slider_23, B=number_slider_24)  # disabled
X_2 = UnitX(Factor=1)  # disabled
number_slider_25 = Slider(1000, range=0..5000)  # disabled
number_slider_26 = Slider(80, range=0..5000)  # disabled
number_slider_27 = Slider(1000, range=0..5000)  # disabled
number_slider_28 = Slider(20, range=0..5000)  # disabled
contour = Contour(Shape=wbcatmullclark, Point=Point(0, 0, 0), Direction=X, Distance=division_7)  # disabled
contour_2 = Contour(Shape=wbcatmullclark_2, Point=Point(0, 0, 0), Direction=X_2, Distance=division_8)  # disabled
boundary = BoundarySurfaces(Edges=contour)  # disabled
wbnaked = WeaverbirdsNakedBoundary(MeshClosedPolylines=contour_2)  # disabled
division_9 = Division(A=number_slider_25, B=number_slider_26)  # disabled
division_10 = Division(A=number_slider_27, B=number_slider_28)  # disabled
preview = CustomPreview(Material={diffuse=RGB(221, 160, 221), emission=RGB(66, 48, 66), shine=0.5, specular=RGB(255, 255, 255), transparency=0})  # disabled
X_3 = UnitX(Factor=division_9)  # disabled
X_4 = UnitX(Factor=division_10)  # disabled
extr_38 = Extrude(Base=boundary, Direction=X_3)  # disabled
extr_39 = Extrude(Base=wbnaked, Direction=X_4)  # disabled
cap_2 = CapHoles(Brep=extr_38)  # disabled
patch = Patch(Spans=20, Flexibility=1, Trim=True)  # disabled

# ==== cluster Cluster

# ==== cluster Cluster_2
crv = ClusterInput()
L = ClusterInput()
curvepoint = ClusterInput()
curvepoint_2 = ClusterInput()
crv_2 = Curve(crv)
number_slider = Slider(0.01, range=0..0.01)
curvepoint_3 = PointOnCurve(curvepoint_2, parameter=0.759)
curvepoint_4 = PointOnCurve(curvepoint, parameter=1)
curvepoint_5 = PointOnCurve(crv_2, parameter=0.412)
crv_cp = CurveClosestPoint(Point=curvepoint_5, Curve=crv_2)  # -> Point, Parameter, Distance
number_slider_2 = ClusterOutput(Slider(0.5, range=0..1))
smaller = SmallerThan(FirstNumber=crv_cp.Distance, SecondNumber=Slider(0.03, range=0..10))  # -> SmallerThan, OrEqualTo
dom = ConstructDomain(DomainStart=Slider(0.01, range=0..0.01), DomainEnd=Slider(0.04, range=0..0.1))
I = ClusterOutput(dom)
dispatch = Dispatch(List=[crv_2, L], DispatchPattern=smaller.SmallerThan)  # -> ListA, ListB
crv_3 = Curve(dispatch.ListA)
crv_4 = ClusterOutput(crv_3)

# ==== cluster Cluster_3
crv = ClusterInput()
curvepoint = ClusterInput()
crv_2 = Curve(crv)
curvepoint_2 = ClusterInput()
number_slider = Slider(0.01, range=0..0.01)
curvepoint_3 = PointOnCurve(curvepoint, parameter=0.759)
curvepoint_4 = PointOnCurve(curvepoint_2, parameter=1)
curvepoint_5 = PointOnCurve(crv_2, parameter=0.412)
crv_cp = CurveClosestPoint(Point=curvepoint_5, Curve=crv_2)  # -> Point, Parameter, Distance
smaller = SmallerThan(FirstNumber=crv_cp.Distance, SecondNumber=Slider(0.03, range=0..10))  # -> SmallerThan, OrEqualTo
L = ClusterInput()
dom = ConstructDomain(DomainStart=Slider(0.01, range=0..0.01), DomainEnd=Slider(0.04, range=0..0.1))
dispatch = Dispatch(List=[crv_2, L], DispatchPattern=smaller.SmallerThan)  # -> ListA, ListB
number_slider_2 = ClusterOutput(Slider(0.5, range=0..1))
I = ClusterOutput(dom)
crv_3 = Curve(dispatch.ListA)
crv_4 = ClusterOutput(crv_3)

# ==== cluster Cluster_5
P = ClusterInput()
P_2 = ClusterInput()
B = ClusterInput()
B_2 = ClusterInput()
cluster = Cluster_4(P=P, P_2=P_2, B=B, B_2=B_2)  # -> L, V
L = ClusterOutput(cluster.L)
V = ClusterOutput(cluster.V)

# ==== cluster Cluster_4
P = ClusterInput()
P_2 = ClusterInput()
pdecon = Deconstruct(Point=P)  # -> XComponent, YComponent, ZComponent
pdecon_2 = Deconstruct(Point=P_2)  # -> XComponent, YComponent, ZComponent
B = ClusterInput()
subtraction = Subtraction(A=pdecon.ZComponent, B=pdecon_2.ZComponent)
division = Division(A=subtraction, B=B)
Z = UnitZ(Factor=division)
B_2 = ClusterInput()
extr = Extrude(Base=B_2, Direction=Z)
debrep = DeconstructBrep(Brep=extr)  # -> Faces, Edges, Vertices
item = ListItem(List=debrep.Edges, Index=0, Wrap=True)  # -> Item, Item1, Item2, Item3
crv = Curve(flatten(item.Item3))
crv_2 = Curve(flatten(item.Item1))
cull_i = CullIndex(List=crv_2, Indices="0", Wrap=True)  # -> simplify(graft(List))
cull_i_2 = CullIndex(List=crv, Indices="10", Wrap=True)  # -> simplify(graft(List))
panel = Panel(cull_i)
panel_2 = Panel(cull_i_2)
flip = FlipCurve(Curve=cull_i_2)  # -> Curve, Flag
crv_3 = Curve([flip.Curve, cull_i])
panel_3 = Panel(crv_3)
loft = Loft(Curves=crv_3, Options={Adjust=False, Closed=False, LoftEnds=0, LoftSimp=0, LoftType=0, Rebuild=10, Refit=0.01})
L = ClusterOutput(loft)
panel_4 = Panel(cull_i_2)  # disabled
Z_2 = UnitZ(Factor=Slider(0.05, range=0..5))
V = ClusterOutput(Z_2)
