# Grasshopper definition 240831 subd structure as_railing1.gh (Grasshopper 1.0.7)
# plug-ins: Bifocals, Weaverbird

number_slider = Slider(15, range=0..100)
number_slider_2 = Slider(10, range=0..100)
number_slider_3 = Slider(15, range=0..100)
number_slider_4 = Slider(0.46, range=0..1)
number_slider_5 = Slider(0.46, range=0..1)
number_slider_6 = Slider(0.46, range=0..1)
flip = FlipCurve()  # -> Curve, Flag
top_curve = Curve(<curve referenced from the Rhino model>)
bottom_crv = Curve(<curve referenced from the Rhino model>)
top_curve_2 = Curve(<curve referenced from the Rhino model>)
bottom_crv_2 = Curve(<curve referenced from the Rhino model>)
top_curve_3 = Curve(<curve referenced from the Rhino model>)
bottom_crv_3 = Curve(<curve referenced from the Rhino model>)
flip_2 = FlipCurve(Curve=bottom_crv_3)  # -> Curve, Flag
curvepoint = PointOnCurve(top_curve, parameter=0.5)
curvepoint_2 = PointOnCurve(top_curve_3, parameter=0.5)
curvepoint_3 = PointOnCurve(top_curve_2, parameter=0.5)
curvepoint_4 = PointOnCurve(bottom_crv, parameter=0.5)
curvepoint_5 = PointOnCurve(bottom_crv_3, parameter=0.5)
curvepoint_6 = PointOnCurve(bottom_crv_2, parameter=0.5)
range = Range(Domain=Slider(1, range=0..100), Steps=number_slider_3)
range_2 = Range(Domain=Slider(1, range=0..100), Steps=number_slider_2)
range_3 = Range(Domain=Slider(1, range=0..100), Steps=number_slider)
tweencrv = TweenCurve(CurveA=top_curve, CurveB=bottom_crv, Factor=range, BlendType=0)
tweencrv_2 = TweenCurve(CurveA=top_curve_3, CurveB=flip_2.Curve, Factor=range_2, BlendType=0)
tweencrv_3 = TweenCurve(CurveA=top_curve_2, CurveB=bottom_crv_2, Factor=range_3, BlendType=0)
pdecon = Deconstruct(Point=curvepoint)  # -> XComponent, YComponent, ZComponent
pdecon_2 = Deconstruct(Point=curvepoint_2)  # -> XComponent, YComponent, ZComponent
pdecon_3 = Deconstruct(Point=curvepoint_3)  # -> XComponent, YComponent, ZComponent
pdecon_4 = Deconstruct(Point=curvepoint_4)  # -> XComponent, YComponent, ZComponent
pdecon_5 = Deconstruct(Point=curvepoint_5)  # -> XComponent, YComponent, ZComponent
pdecon_6 = Deconstruct(Point=curvepoint_6)  # -> XComponent, YComponent, ZComponent
subtraction = Subtraction(A=pdecon.ZComponent, B=pdecon_4.ZComponent)
subtraction_2 = Subtraction(A=pdecon_2.ZComponent, B=pdecon_5.ZComponent)
subtraction_3 = Subtraction(A=pdecon_3.ZComponent, B=pdecon_6.ZComponent)
division = Division(A=subtraction, B=number_slider_3)
division_2 = Division(A=subtraction_2, B=number_slider_2)
division_3 = Division(A=subtraction_3, B=number_slider)
Z = UnitZ(Factor=division)
Z_2 = UnitZ(Factor=division_2)
Z_3 = UnitZ(Factor=division_3)
extr = Extrude(Base=tweencrv, Direction=Z)
extr_2 = Extrude(Base=tweencrv_2, Direction=Z_2)
extr_3 = Extrude(Base=tweencrv_3, Direction=Z_3)
debrep = DeconstructBrep(Brep=extr)  # -> Faces, Edges, Vertices
debrep_2 = DeconstructBrep(Brep=extr_2)  # -> Faces, Edges, Vertices
debrep_3 = DeconstructBrep(Brep=extr_3)  # -> Faces, Edges, Vertices
item = ListItem(List=debrep.Edges, Index=0, Wrap=True)  # -> Item, Item1, Item2, Item3
item_2 = ListItem(List=debrep_2.Edges, Index=0, Wrap=True)  # -> Item, Item1, Item2, Item3
item_3 = ListItem(List=debrep_3.Edges, Index=0, Wrap=True)  # -> Item, Item1, Item2, Item3
crv = Curve(flatten(item.Item3))
crv_2 = Curve(flatten(item_3.Item3))
crv_3 = Curve(flatten(item_2.Item3))
crv_4 = Curve(flatten(item_2.Item1))
crv_5 = Curve(flatten(item.Item1))
crv_6 = Curve(flatten(item_3.Item1))
cull_i = CullIndex(List=crv_5, Indices="0", Wrap=True)  # -> simplify(graft(List))
cull_i_2 = CullIndex(List=crv_4, Indices="0", Wrap=True)  # -> simplify(graft(List))
cull_i_3 = CullIndex(List=crv_6, Indices="0", Wrap=True)  # -> simplify(graft(List))
cull_i_4 = CullIndex(List=crv, Indices="15", Wrap=True)  # -> simplify(graft(List))
cull_i_5 = CullIndex(List=crv_3, Indices="10", Wrap=True)  # -> simplify(graft(List))
cull_i_6 = CullIndex(List=crv_2, Indices="15", Wrap=True)  # -> simplify(graft(List))
panel = Panel(cull_i)
panel_2 = Panel(cull_i_3)
panel_3 = Panel(cull_i_2)
panel_4 = Panel(cull_i_4)
panel_5 = Panel(cull_i_6)
panel_6 = Panel(cull_i_5)
flip_3 = FlipCurve(Curve=cull_i_4)  # -> Curve, Flag
flip_4 = FlipCurve(Curve=cull_i_5)  # -> Curve, Flag
flip_5 = FlipCurve(Curve=cull_i_6)  # -> Curve, Flag
crv_7 = Curve([flip_4.Curve, cull_i_2])
crv_8 = Curve([flip_3.Curve, cull_i])
crv_9 = Curve([flip_5.Curve, cull_i_3])
panel_7 = Panel(crv_8)
panel_8 = Panel(crv_9)
panel_9 = Panel(crv_7)
loft = Loft(Curves=crv_8, Options={Adjust=False, Closed=False, LoftEnds=0, LoftSimp=0, LoftType=0, Rebuild=10, Refit=0.01})
loft_2 = Loft(Curves=crv_7, Options={Adjust=False, Closed=False, LoftEnds=0, LoftSimp=0, LoftType=0, Rebuild=10, Refit=0.01})
loft_3 = Loft(Curves=crv_9, Options={Adjust=False, Closed=False, LoftEnds=0, LoftSimp=0, LoftType=0, Rebuild=10, Refit=0.01})
panel_10 = Panel(cull_i_6)  # disabled
panel_11 = Panel(cull_i_5)  # disabled
panel_12 = Panel(cull_i_4)  # disabled
Z_4 = UnitZ(Factor=Slider(0.02, range=0..5))
Z_5 = UnitZ(Factor=Slider(0.05, range=0..5))
Z_6 = UnitZ(Factor=Slider(0.05, range=0..5))
extr_4 = Extrude(Base=loft, Direction=Z_4)
extr_5 = Extrude(Base=loft_2, Direction=Z_5)
extr_6 = Extrude(Base=loft_3, Direction=Z_6)

debrep_4 = DeconstructBrep(Brep=extr_6)  # -> Faces, Edges, Vertices
debrep_5 = DeconstructBrep(Brep=extr_6)  # -> Faces, Edges, Vertices
item_4 = ListItem(List=debrep_4.Vertices, Index=Slider(5, range=0..10), Wrap=True)
item_5 = ListItem(List=debrep_5.Vertices, Index=Slider(4, range=0..10), Wrap=True)
merge = Merge(Data1=item_4, Data2=item_5)
weave = Weave(Pattern=[0, 1], Stream0=item_4, Stream1=item_5, NullGaps=False)
ln = Line(StartPoint=item_4, EndPoint=item_5)
intcrv = Interpolate(Vertices=flatten([item_5, item_4]), Degree=3, Periodic=False, KnotStyle=1)  # -> Curve, Length, Domain
Z_7 = UnitZ(Factor=Slider(0.9, range=0..1))
move = Move(Geometry=intcrv.Curve, Motion=Z_7)  # -> Geometry, Transform
crv_10 = Curve(move.Geometry)
crv_11 = Curve(intcrv.Curve)
loft_4 = Loft(
    Curves=[crv_10, crv_11],
    Options=flatten({Adjust=False, Closed=False, LoftEnds=0, LoftSimp=0, LoftType=0, Rebuild=10, Refit=0.01}))

number_slider_7 = Slider(0.4, range=0..1)  # disabled
srf = Surface(<surface referenced from the Rhino model>)
panel_13 = Panel("""0
1""")  # disabled
trigrid = Triangular(Plane=PlaneXY(0, 0, 0), Size=number_slider_7, ExtentX=crv_11, ExtentY=crv_10)  # -> Cells, Points; disabled
pop2d = Populate2D(Region=srf, Count=Slider(23, range=0..100), Seed=1)
flatten = FlattenTree(Tree=trigrid.Cells, Path="{0}")  # disabled
voronoi = Voronoi(Points=pop2d, Boundary=srf, BruteForceOverride=False)
item_6 = ListItem(List=flatten, Index=panel_13, Wrap=True)  # disabled
scale = Scale(Geometry=voronoi, Center=pop2d, Factor=Slider(0.8, range=0..1))  # -> Geometry, Transform
explode = Explode(Curve=flatten, Recursive=True)  # -> Segments, Vertices; disabled
area = Area(Geometry=flatten)  # -> Area, Centroid; disabled
panel_14 = Panel("0.5")  # disabled
debrep_6 = DeconstructBrep(Brep=scale.Geometry)  # -> Faces, Edges, Vertices
graft = GraftTree(Tree=area.Centroid, IncludeEmptyLists=True, IncludeNullItems=True)  # disabled
panel_15 = Panel(graft)  # disabled
pt = Point(<point referenced from the Rhino model>)  # disabled
eval = EvaluateLength(Curve=reparameterize(explode.Segments), Length=panel_14, Normalized=True)  # -> Point, Tangent, Parameter; disabled
intcrv_2 = Interpolate(Vertices=debrep_6.Vertices, Degree=3, Periodic=Toggle(False), KnotStyle=1)  # -> flatten(Curve), Length, Domain
number_slider_8 = Slider(0.11, range=0..1)  # disabled
ln_2 = Line(StartPoint=eval.Point, EndPoint=graft)  # disabled
dist = Distance(PointA=graft, PointB=pt)  # disabled
Y = UnitY(Factor=Slider(0.03, range=0..5))
number_slider_9 = Slider(0.5, range=0..1)  # disabled
srfsplit = SurfaceSplit(Surface=reparameterize(debrep_6.Faces), Curves=intcrv_2.Curve)
extr_7 = Extrude(Base=loft_4, Direction=Y)
flatten_2 = FlattenTree(Tree=dist, Path="{0}")  # disabled
Z_8 = UnitZ(Factor=number_slider_8)  # disabled
number_slider_10 = Slider(0.9, range=0..1)
pt_2 = Point(item_5)  # disabled
move_2 = Move(Geometry=graft, Motion=Z_8)  # -> Geometry, Transform; disabled
bnd = Bounds(Numbers=flatten_2)  # disabled
volume = Volume(Geometry=extr_7)  # -> Volume, Centroid
area_2 = Area(Geometry=srfsplit)  # -> Area, Centroid
panel_16 = Panel(area_2.Area)
number_slider_11 = Slider(0, range=0..100)  # disabled
number_slider_12 = Slider(1, range=0..1)  # disabled
item_7 = ListItem(List=srfsplit, Index=Slider(34, range=0..100), Wrap=True)
data = Data(dist)  # disabled
scale_2 = Scale(Center=volume.Centroid, Factor=number_slider_10)  # -> Geometry, Transform
Z_9 = UnitZ(Factor=Slider(0.1, range=0..0.1))
extr_8 = Extrude(Base=item_7, Direction=Z_9)
pop3d = Populate3D(Region={Plane=PlaneXY(0, 0, 0), X=Domain(0, 10), Y=Domain(0, 10), Z=Domain(0, 2)}, Count=Slider(5, range=0..100), Seed=1)
dom = ConstructDomain(DomainStart=number_slider_11, DomainEnd=number_slider_12)  # disabled
remap = RemapNumbers(Value=data, Source=bnd, Target=dom)  # -> Mapped, Clipped; disabled
eval_2 = EvaluateLength(Curve=reparameterize(ln_2), Length=remap.Mapped, Normalized=True)  # -> Point, Tangent, Parameter; disabled
weave_2 = Weave(Pattern=[0, 1], Stream0=pt_2, Stream1=eval_2.Point, NullGaps=False)  # disabled
pline = PolyLine(Vertices=weave_2, Closed=False)  # disabled
extr_9 = ExtrudePoint(Base=pline, Point=move_2.Geometry)  # disabled
voronoi³ = Voronoi3D(Points=pop3d)  # -> Cells, Boundary
volume_2 = Volume(Geometry=voronoi³.Cells)  # -> Volume, Centroid
scale_3 = Scale(Geometry=voronoi³.Cells, Center=volume_2.Centroid, Factor=number_slider_10)  # -> Geometry, Transform
sdiff = SolidDifference(BrepsA=extr_7, BrepsB=scale_3.Geometry)
debrep_7 = DeconstructBrep(Brep=sdiff)  # -> Faces, Edges, Vertices
mesh = MeshBrep(
    Brep=debrep_7.Faces,
    Settings={GridMaxCount=0, GridMinCount=16, JaggedSeams=False, MaxEdgeLength=0, MinEdgeLength=0.0001, MinTolerance=0, Refine=True, RefineAngle=0, RelativeTolerance=0.65, SimplePlanes=True, Tolerance=0})
mjoin = MeshJoin(Meshes=mesh)
number_slider_13 = Slider(50, range=0..100)  # disabled

number_slider_14 = Slider(1000, range=0..5000)  # disabled
number_slider_15 = Slider(1000, range=0..5000)  # disabled
number_slider_16 = Slider(1000, range=0..5000)  # disabled
rectangle = Rectangle(Plane=PlaneXY(0, 0, 0), XSize=number_slider_14, YSize=number_slider_15, Radius=0)  # -> Rectangle, Length; disabled
Z_10 = UnitZ(Factor=number_slider_16)  # disabled
extr_10 = Extrude(Base=rectangle.Rectangle, Direction=Z_10)  # disabled
cap = CapHoles(Brep=extr_10)  # disabled

subd = SubD(<subd referenced from the Rhino model>)  # disabled
number_slider_17 = Slider(0.9, range=0..1)  # disabled
number_slider_18 = Slider(0.9, range=0..1)  # disabled
volume_3 = Volume(Geometry=cap)  # -> Volume, Centroid; disabled
volume_4 = Volume(Geometry=subd)  # -> Volume, Centroid; disabled
number_slider_19 = Slider(50, range=0..100)  # disabled
scale_4 = Scale(Geometry=cap, Center=volume_3.Centroid, Factor=number_slider_17)  # -> Geometry, Transform; disabled
scale_5 = Scale(Geometry=subd, Center=volume_4.Centroid, Factor=number_slider_18)  # -> Geometry, Transform; disabled
pop3d_2 = Populate3D(Region=extr_10, Count=number_slider_13, Seed=1)  # disabled
pop3d_3 = Populate3D(Region=subd, Count=number_slider_19, Seed=1)  # disabled
voronoi³_2 = Voronoi3D(Points=pop3d_2)  # -> Cells, Boundary; disabled
voronoi³_3 = Voronoi3D(Points=pop3d_3)  # -> Cells, Boundary; disabled
volume_5 = Volume(Geometry=voronoi³_2.Cells)  # -> Volume, Centroid; disabled
volume_6 = Volume(Geometry=voronoi³_3.Cells)  # -> Volume, Centroid; disabled
scale_6 = Scale(Geometry=voronoi³_2.Cells, Center=volume_5.Centroid, Factor=number_slider_17)  # -> Geometry, Transform; disabled
scale_7 = Scale(Geometry=voronoi³_3.Cells, Center=volume_6.Centroid, Factor=number_slider_18)  # -> Geometry, Transform; disabled
sdiff_2 = SolidDifference(BrepsA=scale_4.Geometry, BrepsB=scale_6.Geometry)  # disabled
sdiff_3 = SolidDifference(BrepsA=scale_5.Geometry, BrepsB=scale_7.Geometry)  # disabled
debrep_8 = DeconstructBrep(Brep=sdiff_2)  # -> Faces, Edges, Vertices; disabled
debrep_9 = DeconstructBrep(Brep=sdiff_3)  # -> Faces, Edges, Vertices; disabled
mesh_2 = MeshBrep(
    Brep=debrep_8.Faces,
    Settings={GridMaxCount=0, GridMinCount=16, JaggedSeams=False, MaxEdgeLength=0, MinEdgeLength=0.0001, MinTolerance=0, Refine=True, RefineAngle=0, RelativeTolerance=0.65, SimplePlanes=True, Tolerance=0})  # disabled
mesh_3 = MeshBrep(
    Brep=debrep_9.Faces,
    Settings={GridMaxCount=0, GridMinCount=16, JaggedSeams=False, MaxEdgeLength=0, MinEdgeLength=0.0001, MinTolerance=0, Refine=True, RefineAngle=0, RelativeTolerance=0.65, SimplePlanes=True, Tolerance=0})  # disabled
number_slider_20 = Slider(3, range=0..10)  # disabled
number_slider_21 = Slider(3, range=0..10)  # disabled
mjoin_2 = MeshJoin(Meshes=mesh_2)  # disabled
mjoin_3 = MeshJoin(Meshes=mesh_3)  # disabled
number_slider_22 = Slider(2000, range=0..5000)  # disabled
number_slider_23 = Slider(80, range=0..5000)  # disabled
number_slider_24 = Slider(2000, range=0..5000)  # disabled
number_slider_25 = Slider(20, range=0..5000)  # disabled
wbcatmullclark = WeaverbirdsCatmullClarkSubdivision(MeshCurves=mjoin_2, Level=number_slider_20, SmoothNakedEdges=1)  # disabled
wbcatmullclark_2 = WeaverbirdsCatmullClarkSubdivision(MeshCurves=mjoin_3, Level=number_slider_21, SmoothNakedEdges=1)  # disabled
division_4 = Division(A=number_slider_22, B=number_slider_23)  # disabled
X = UnitX(Factor=1)  # disabled
division_5 = Division(A=number_slider_24, B=number_slider_25)  # disabled
X_2 = UnitX(Factor=1)  # disabled
number_slider_26 = Slider(1000, range=0..5000)  # disabled
number_slider_27 = Slider(80, range=0..5000)  # disabled
number_slider_28 = Slider(1000, range=0..5000)  # disabled
number_slider_29 = Slider(20, range=0..5000)  # disabled
contour = Contour(Shape=wbcatmullclark, Point=Point(0, 0, 0), Direction=X, Distance=division_4)  # disabled
contour_2 = Contour(Shape=wbcatmullclark_2, Point=Point(0, 0, 0), Direction=X_2, Distance=division_5)  # disabled
boundary = BoundarySurfaces(Edges=contour)  # disabled
wbnaked = WeaverbirdsNakedBoundary(MeshClosedPolylines=contour_2)  # disabled
division_6 = Division(A=number_slider_26, B=number_slider_27)  # disabled
division_7 = Division(A=number_slider_28, B=number_slider_29)  # disabled
preview = CustomPreview(Material={diffuse=RGB(221, 160, 221), emission=RGB(66, 48, 66), shine=0.5, specular=RGB(255, 255, 255), transparency=0})  # disabled
X_3 = UnitX(Factor=division_6)  # disabled
X_4 = UnitX(Factor=division_7)  # disabled
extr_11 = Extrude(Base=boundary, Direction=X_3)  # disabled
extr_12 = Extrude(Base=wbnaked, Direction=X_4)  # disabled
cap_2 = CapHoles(Brep=extr_11)  # disabled
patch = Patch(Spans=20, Flexibility=1, Trim=True)  # disabled
