# Grasshopper definition Ceramic Punk_Spiral Staircase.ghx (Grasshopper 1.0.7)
# plug-ins: Kangaroo2 Components

# ----
# Core with point attractor but didn't work for SubD
crv = Curve(<curve referenced from the Rhino model>)
crv_2 = Curve(<curve referenced from the Rhino model>)
revsrf = Revolution(Curve=crv, Axis=crv_2, Domain=Domain(0, 6.283185307))
brep = Brep(revsrf)
bbox = BoundingBox(Content=brep, Plane=PlaneXY(0, 0, 0))  # -> Box, Box_2
popgeo = PopulateGeometry(Geometry=brep, Count=Slider(200, range=0..1000), Seed=1)
voronoi³ = Voronoi3D(Points=popgeo, Box=bbox.Box)  # -> Cells, Boundary
bbx = BrepBrep(BrepA=brep, BrepB=voronoi³.Cells)  # -> Curves, Points
area = Area(Geometry=voronoi³.Cells)  # -> Area, Centroid
pt = Point(<point referenced from the Rhino model>)
disc = Discontinuity(Curve=bbx.Curves, Level=1)  # -> Points, Parameters
dist = Distance(PointA=area.Centroid, PointB=pt)
dom = ConstructDomain(DomainStart=Slider(0, range=0..1), DomainEnd=Slider(1, range=0..1))
number_slider = Slider(10, range=0..10)
pline = PolyLine(Vertices=disc.Points, Closed=invert(False))
bnd = Bounds(Numbers=dist)
clean = CleanTree(RemoveNulls=True, RemoveInvalid=True, RemoveEmpty=invert(False), Tree=pline)
division = Division(A=dist, B=Slider(4433, range=0..5000))
remap = RemapNumbers(Value=dist, Source=bnd, Target=dom)  # -> Mapped, Clipped
fillet = Fillet(Curve=clean, Radius=Slider(1525, range=0..5000))
pcen = PolygonCenter(Polyline=clean)  # -> CenterV, CenterE, CenterA
scale = Scale(Geometry=voronoi³.Cells, Center=area.Centroid, Factor=division)  # -> Geometry, Transform
brep_2 = Brep(scale.Geometry)
scale_2 = Scale(Geometry=fillet, Center=pcen.CenterV, Factor=Slider(0.9, range=0..1))  # -> Geometry, Transform
bbx_2 = BrepBrep(BrepA=brep_2, BrepB=brep)  # -> Curves, Points
loft = Loft(
    Curves=[scale_2.Geometry, fillet],
    Options={Adjust=False, Closed=False, LoftEnds=0, LoftSimp=0, LoftType=0, Rebuild=10, Refit=0.01})  # -> flatten(Loft)
disc_2 = Discontinuity(Curve=bbx_2.Curves, Level=1)  # -> Points, Parameters
edges = BrepEdges(Brep=loft)  # -> Naked, Interior, NonManifold
pline_2 = PolyLine(Vertices=disc_2.Points, Closed=invert(False))
mp = MultiPipe(
    Curves=edges.Naked,
    NodeSize=Slider(15, range=0..100),
    EndOffset=Slider(0, range=0..1),
    StrutSize=Slider(2, range=0..10),
    Segment=0,
    KinkAngle=0.6,
    CubeFit=0,
    Caps=0)
clean_2 = CleanTree(RemoveNulls=True, RemoveInvalid=True, RemoveEmpty=invert(False), Tree=pline_2)
fillet_2 = Fillet(Curve=clean_2, Radius=Slider(87, range=0..100))
pcen_2 = PolygonCenter(Polyline=clean_2)  # -> CenterV, CenterE, CenterA
scale_3 = Scale(Geometry=fillet_2, Center=pcen_2.CenterV, Factor=Slider(0.9, range=0..1))  # -> Geometry, Transform
loft_2 = Loft(
    Curves=[scale_3.Geometry, fillet_2],
    Options={Adjust=False, Closed=False, LoftEnds=0, LoftSimp=0, LoftType=0, Rebuild=10, Refit=0.01})  # -> flatten(Loft)
edges_2 = BrepEdges(Brep=loft_2)  # -> Naked, Interior, NonManifold
mp_2 = MultiPipe(
    Curves=edges_2.Naked,
    NodeSize=Slider(2, range=0..100),
    EndOffset=Slider(0, range=0..1),
    StrutSize=Slider(1, range=0..10),
    Segment=0,
    KinkAngle=0.6,
    CubeFit=0,
    Caps=0)
preview = CustomPreview(Material=ColourSwatch(SwatchColor=RGB(217, 214, 200)))

# ----
# Core
number_slider_2 = Slider(200, range=0..1000)
geo = Geometry(<brep referenced from the Rhino model>)
bbox_2 = BoundingBox(Content=geo, Plane=PlaneXY(0, 0, 0))  # -> Box, Box_2
popgeo_2 = PopulateGeometry(Geometry=geo, Count=number_slider_2, Seed=1)
voronoi³_2 = Voronoi3D(Points=popgeo_2, Box=bbox_2.Box)  # -> Cells, Boundary
bbx_3 = BrepBrep(BrepA=geo, BrepB=voronoi³_2.Cells)  # -> Curves, Points
disc_3 = Discontinuity(Curve=bbx_3.Curves, Level=1)  # -> Points, Parameters
pline_3 = PolyLine(Vertices=disc_3.Points, Closed=invert(False))
clean_3 = CleanTree(RemoveNulls=True, RemoveInvalid=True, RemoveEmpty=invert(False), Tree=pline_3)
fillet_3 = Fillet(Curve=clean_3, Radius=Slider(1525, range=0..5000))
pcen_3 = PolygonCenter(Polyline=clean_3)  # -> CenterV, CenterE, CenterA
scale_4 = Scale(Geometry=fillet_3, Center=pcen_3.CenterV, Factor=Slider(0.9, range=0..1))  # -> Geometry, Transform
loft_3 = Loft(
    Curves=[scale_4.Geometry, fillet_3],
    Options={Adjust=False, Closed=False, LoftEnds=0, LoftSimp=0, LoftType=0, Rebuild=10, Refit=0.01})  # -> flatten(Loft)
edges_3 = BrepEdges(Brep=loft_3)  # -> Naked, Interior, NonManifold
mp_3 = MultiPipe(
    Curves=edges_3.Naked,
    NodeSize=Slider(15, range=0..100),
    EndOffset=Slider(0, range=0..1),
    StrutSize=Slider(2, range=0..10),
    Segment=0,
    KinkAngle=0.6,
    CubeFit=0,
    Caps=0)
preview_2 = CustomPreview(Geometry=mp_3, Material=ColourSwatch(SwatchColor=RGB(217, 214, 200)))

# ---- group: Stairs
# Staircase
construct_point = ConstructPoint(XCoordinate=0, YCoordinate=0, ZCoordinate=0)
division_2 = Division(A=Slider(1000, range=0..10000), B=1)
point = Point(construct_point)
circle = Circle(Plane=point, Radius=division_2)
boundary_surfaces = BoundarySurfaces(Edges=circle)
offset_curve = OffsetCurve(Curve=circle, Distance=Slider(2000, range=0..2700), Plane=PlaneXY(0, 0, 0), Corners=1)
boundary_surfaces_2 = BoundarySurfaces(Edges=flatten([offset_curve, circle]))
number_of_steps = Slider(50, range=0..100)
end_points = EndPoints(Curve=circle)  # -> Start, End
end_points_2 = EndPoints(Curve=offset_curve)  # -> Start, End
line = Line(StartPoint=end_points.Start, EndPoint=end_points_2.Start)
division_3 = Division(A="720", B=number_of_steps)
rotate = Rotate(Geometry=line, Angle=degrees(division_3), Plane=point)  # -> Geometry, Transform
number_slider_3 = Slider(150, range=0..1000)
surface_split = SurfaceSplit(Surface=boundary_surfaces_2, Curves=[line, rotate.Geometry])
multiplication = Multiplication(A=number_slider_3, B=number_of_steps)
series = Series(Start=number_slider_3, Step=number_slider_3, Count=number_of_steps)
unit_z = UnitZ(Factor=multiplication)
list_item = ListItem(List=surface_split, Index=0, Wrap=True)
negative = Negative(Value=number_slider_3)
series_2 = Series(Start=0, Step=division_3, Count=number_of_steps)
extrude = Extrude(Base=boundary_surfaces, Direction=unit_z)
boundary = BoundarySurfaces(Edges=list_item)
rotate_2 = Rotate(Geometry=list_item, Angle=degrees(series_2), Plane=PlaneXY(0, 0, 0))  # -> Geometry, Transform
unit_z_2 = UnitZ(Factor=series)
explode = Explode(Curve=boundary, Recursive=True)  # -> Segments, Vertices
unit_z_3 = UnitZ(Factor=negative)
move = Move(Geometry=rotate_2.Geometry, Motion=unit_z_2)  # -> Geometry, Transform
extrude_2 = Extrude(Base=move.Geometry, Direction=unit_z_3)
preview_3 = CustomPreview(Geometry=extrude_2, Material=ColourSwatch(SwatchColor=RGB(217, 214, 200)))
rotate_3 = Rotate(Geometry=extrude_2, Angle=degrees("180"), Plane=PlaneXY(0, 0, 0))  # -> Geometry, Transform

# ---- group: Veins
midpt = CurveMiddle(Curve=explode.Segments)
point_2 = Point(construct_point)
item = ListItem(List=midpt, Index=0, Wrap=True)
unit_z_4 = UnitZ(Factor=Slider(150, range=0..1000))
rotate_4 = Rotate(Geometry=item, Angle=degrees(series_2), Plane=PlaneXY(0, 0, 0))  # -> Geometry, Transform
unit_z_5 = UnitZ(Factor=series)
move_2 = Move(Geometry=item, Motion=unit_z_4)  # -> Geometry, Transform
negative_2 = Negative(Value=number_slider_3)
move_3 = Move(Geometry=rotate_4.Geometry, Motion=unit_z_5)  # -> Geometry, Transform
unit_z_6 = UnitZ(Factor=negative_2)
move_4 = Move(Geometry=move_3.Geometry, Motion=unit_z_6)  # -> Geometry, Transform
ln = Line(StartPoint=move_3.Geometry, EndPoint=move_4.Geometry)
ln_2 = Line(StartPoint=move_4.Geometry, EndPoint=point_2)
explode_2 = Explode(Curve=ln_2, Recursive=True)  # -> flatten(Segments), Vertices
number_slider_4 = Slider(54, range=0..100)
number_slider_5 = Slider(0, range=0..0.1)
number_slider_6 = Slider(0.5, range=0..1)
explode_3 = Explode(Curve=ln, Recursive=True)  # -> flatten(Segments), Vertices
mp_4 = MultiPipe(
    Curves=explode_2.Segments,
    NodeSize=number_slider_4,
    EndOffset=number_slider_5,
    StrutSize=number_slider_6,
    Segment=0,
    KinkAngle=0.6,
    CubeFit=0,
    Caps=1)
mp_5 = MultiPipe(
    Curves=explode_3.Segments,
    NodeSize=Slider(31, range=0..100),
    EndOffset=Slider(0, range=0..0.1),
    StrutSize=number_slider_6,
    Segment=0,
    KinkAngle=0.6,
    CubeFit=0,
    Caps=2)
preview_4 = CustomPreview(Geometry=mp_5, Material=ColourSwatch(SwatchColor=RGB(217, 214, 200)))
preview_5 = CustomPreview(Geometry=mp_4, Material=ColourSwatch(SwatchColor=RGB(217, 214, 200)))
rotate_5 = Rotate(Geometry=mp_4, Angle=degrees("180"), Plane=PlaneXY(0, 0, 0))  # -> Geometry, Transform

# ---- group: Railing
end = EndPoints(Curve=explode.Segments)  # -> Start, End
item_2 = ListItem(List=end.Start, Index=0, Wrap=True)  # -> Item, Item1
unit_z_7 = UnitZ(Factor=series)
unit_z_8 = UnitZ(Factor=series)
rotate_6 = Rotate(Geometry=item_2.Item, Angle=degrees(series_2), Plane=PlaneXY(0, 0, 0))  # -> Geometry, Transform
rotate_7 = Rotate(Geometry=item_2.Item1, Angle=degrees(series_2), Plane=PlaneXY(0, 0, 0))  # -> Geometry, Transform
move_5 = Move(Geometry=rotate_6.Geometry, Motion=unit_z_7)  # -> Geometry, Transform
move_6 = Move(Geometry=rotate_7.Geometry, Motion=unit_z_8)  # -> Geometry, Transform
unit_z_9 = UnitZ(Factor=Slider(172, range=0..1000))
move_7 = Move(Geometry=move_5.Geometry, Motion=unit_z_9)  # -> Geometry, Transform

# ---- group: Railing / Iteration2
item_3 = ListItem(List=move_7.Geometry, Index=0, Wrap=True)
item_4 = ListItem(List=move_7.Geometry, Index=1, Wrap=True)
pt_2 = Point(move_2.Geometry)
pline_4 = PolyLine(Vertices=[item_3, item_4, pt_2], Closed=True)
neg = Negative(Value=Slider(150, range=150..1000))
unit_z_10 = UnitZ(Factor=neg)
move_8 = Move(Geometry=pline_4, Motion=unit_z_10)  # -> Geometry, Transform
rotate_8 = Rotate(Geometry=move_8.Geometry, Angle=degrees(series_2), Plane=PlaneXY(0, 0, 0))  # -> Geometry, Transform
unit_z_11 = UnitZ(Factor=series)
move_9 = Move(Geometry=rotate_8.Geometry, Motion=unit_z_11)  # -> Geometry, Transform
explode_4 = Explode(Curve=move_9.Geometry, Recursive=True)  # -> flatten(Segments), Vertices
mp_6 = MultiPipe(
    Curves=explode_4.Segments,
    NodeSize=Slider(16, range=0..100),
    EndOffset=Slider(0.01, range=0..0.1),
    StrutSize=Slider(0.8, range=0..1),
    Segment=0,
    KinkAngle=0.6,
    CubeFit=0,
    Caps=1)

# ---- group: Railing / Iteration1
pline_5 = PolyLine(Vertices=move_7.Geometry, Closed=False)
ln_3 = Line(StartPoint=move_7.Geometry, EndPoint=move_3.Geometry)
explode_5 = Explode(Curve=[pline_5, ln_3], Recursive=True)  # -> flatten(Segments), Vertices
mp_7 = MultiPipe(
    Curves=explode_5.Segments,
    NodeSize=number_slider_4,
    EndOffset=number_slider_5,
    StrutSize=number_slider_6,
    Segment=0,
    KinkAngle=0.6,
    CubeFit=0,
    Caps=1)

# ---- group: Combining curves for multi-pipe
join = JoinCurves(Curves=[ln, pline_5, ln_3, move_9.Geometry], Preserve=False)
explode_6 = Explode(Curve=join, Recursive=True)  # -> flatten(Segments), Vertices
mp_8 = MultiPipe(
    Curves=explode_6.Segments,
    NodeSize=Slider(33, range=0..100),
    EndOffset=Slider(0, range=0..0.1),
    StrutSize=Slider(0.8, range=0..1),
    Segment=0,
    KinkAngle=0.6,
    CubeFit=0,
    Caps=1)
preview_6 = CustomPreview(Geometry=mp_8, Material=ColourSwatch(SwatchColor=RGB(217, 214, 200)))
rotate_9 = Rotate(Geometry=mp_8, Angle=degrees("180"), Plane=PlaneXY(0, 0, 0))  # -> Geometry, Transform
